# Dynamo graph VSCode.dyn (Dynamo 2.10.1.3976)
# packages: Crumple 2022.5.27

boolean = BoolSelector(true)  # frozen
python_script = Python(IN[0]=boolean)  # IronPython2
# ---------- python_script.python (92 lines) ----------
"""Copyright by: vudinhduybm@gmail.com"""
#region ___import all Library
import clr
import sys 
import System   
import math
import collections

from math import cos,sin,tan,radians

clr.AddReference("ProtoGeometry")
from Autodesk.DesignScript.Geometry import *

clr.AddReference("RevitAPI") 
import Autodesk
from Autodesk.Revit.DB import* 
from Autodesk.Revit.DB.Structure import*

clr.AddReference("RevitAPIUI") 
from Autodesk.Revit.UI import*
from Autodesk.Revit.UI.Selection import ISelectionFilter
clr.AddReference("System") 
from System.Collections.Generic import List

clr.AddReference("RevitNodes")
import Revit
clr.ImportExtensions(Revit.Elements)
clr.ImportExtensions(Revit.GeometryConversion)

clr.AddReference("RevitServices")
import RevitServices
from RevitServices.Persistence import DocumentManager
from RevitServices.Transactions import TransactionManager

clr.AddReference("System.Windows.Forms")
clr.AddReference("System.Drawing")
clr.AddReference("System.Windows.Forms.DataVisualization")

import System.Windows.Forms 
from System.Windows.Forms import *
import System.Drawing
from System.Drawing import *
#endregion

#region ___Current doc/app/ui
doc = DocumentManager.Instance.CurrentDBDocument
uiapp = DocumentManager.Instance.CurrentUIApplication
app = uiapp.Application
uidoc = DocumentManager.Instance.CurrentUIApplication.ActiveUIDocument
view = doc.ActiveView
#endregion

#region ___someFunctions
def uwList(input):
    result = input if isinstance(input, list) else [input]
    return UnwrapElement(input)

def getAllPipeFittingsInPJ(doc):
    pipeFittingsName = []
    collector = FilteredElementCollector(doc).OfCategory(BuiltInCategory.OST_PipeFitting).WhereElementIsElementType().ToElements()
    for fitting in collector:
        # Use SYMBOL_NAME_PARAM to get the type name
        fittingNameParam = fitting.get_Parameter(BuiltInParameter.SYMBOL_NAME_PARAM)
        if fittingNameParam:
            fittingName = fittingNameParam.AsString()
            pipeFittingsName.append(fittingName)
    return collector, pipeFittingsName
def getAllPipeAccessoriesInPJ(doc):
    pipeFittingsName = []
    collector = FilteredElementCollector(doc).OfCategory(BuiltInCategory.OST_PipeAccessory).WhereElementIsElementType().ToElements()
    for fitting in collector:
        # Use SYMBOL_NAME_PARAM to get the type name
        fittingNameParam = fitting.get_Parameter(BuiltInParameter.SYMBOL_NAME_PARAM)
        if fittingNameParam:
            fittingName = fittingNameParam.AsString()
            pipeFittingsName.append(fittingName)
    return collector, pipeFittingsName    
def getAllGenericModelInPJ(doc):
    pipeFittingsName = []
    collector = FilteredElementCollector(doc).OfCategory(BuiltInCategory.OST_GenericModel).WhereElementIsElementType().ToElements()
    for fitting in collector:
        # Use SYMBOL_NAME_PARAM to get the type name
        fittingNameParam = fitting.get_Parameter(BuiltInParameter.SYMBOL_NAME_PARAM)
        if fittingNameParam:
            fittingName = fittingNameParam.AsString()
            pipeFittingsName.append(fittingName)
    return collector, pipeFittingsName      
#endregion



OUT =  getAllGenericModelInPJ(doc)
# ----------------------------------------
boolean_2 = BoolSelector(true)
file_path = Filename(".\OKB01.py")
python_script_2 = Python(IN[0]=boolean_2, IN[1]=file_path)  # IronPython2
# ---------- python_script_2.python (5 lines) ----------
re  = open(r"C:\Users\Desktop\Python\02_PyRevit\04_Processing\01_pyRevitAPI\02_Processing\OKB01.py", "r")

interpret = re.read()

OUT =  interpret
# ----------------------------------------
python_script_from_string = PythonStringNode(script=python_script_2)  # IronPython2; unwired: IN[0], IN[1]
code_block = CodeBlock(a=python_script_from_string) { a[0]; }
code_block_2 = CodeBlock(a=python_script_from_string) { a[1]; }
code_block_3 = CodeBlock(a=python_script_from_string) { a[2]; }
code_block_4 = CodeBlock(a=python_script_from_string) { a[3]; }
code_block_5 = CodeBlock(a=python_script_from_string) { a[5]; }
code_block_6 = CodeBlock(a=python_script_from_string) { a[4]; }
code_block_7 = CodeBlock(a=python_script_from_string) { a[6]; }
code_block_8 = CodeBlock(a=python_script_from_string) { a[7]; }
excel_import = Custom[© Excel.Import+]()  # frozen; package Crumple; ImportExcel, with a few extra settings for quicker importing.; unwired: filePath
importexcel = Custom[© ImportExcel]()  # package Crumple; Imports a 2D matrix of data from an existing Excel file path from a given worksheet name. If a worksheet does not exist by that name it will take the data from the first worksheet instead. Credit to Cyril Poupin for most of the Python code (details in node body).; unwired: filePath
