# Dynamo graph runVSCode.dyn (Dynamo 2.10.1.3976)

boolean = BoolSelector(false)
file_path = Filename(".\processing_240615_getColumSize.py")
python_script = Python(IN[0]=boolean, IN[1]=file_path)  # IronPython2
# ---------- python_script.python (5 lines) ----------
re  = open(r"C:\Users\Desktop\Python\02_PyRevit\04_Processing\01_pyRevitAPI\processing_240615_getColumSize.py", "r")

interpret = re.read()

OUT =  interpret
# ----------------------------------------
python_script_from_string = PythonStringNode(script=python_script)  # IronPython2; unwired: IN[0]
code_block = CodeBlock(a=python_script_from_string) { a; }
python_script_2 = Python(IN[0]=code_block)  # IronPython2
# ---------- python_script_2.python (84 lines) ----------
"""Copyright by: vudinhduybm@gmail.com"""
#region ___import all Library
import clr
import sys 
import System   
import math
import collections
import duynamoLibrary as dLib

sys.path.append('')
from math import cos,sin,tan,radians

clr.AddReference("ProtoGeometry")
from Autodesk.DesignScript.Geometry import *

clr.AddReference("RevitAPI") 
import Autodesk
from Autodesk.Revit.DB import* 
from Autodesk.Revit.DB.Structure import*

clr.AddReference("DSCoreNodes")
from DSCore.List import Flatten

clr.AddReference("RevitAPIUI") 
from Autodesk.Revit.UI import*
from Autodesk.Revit.UI.Selection import ISelectionFilter
clr.AddReference("System") 
from System.Collections.Generic import List

clr.AddReference("RevitNodes")
import Revit
clr.ImportExtensions(Revit.Elements)
clr.ImportExtensions(Revit.GeometryConversion)

clr.AddReference("RevitServices")
import RevitServices
from RevitServices.Persistence import DocumentManager
from RevitServices.Transactions import TransactionManager

clr.AddReference("System.Windows.Forms")
clr.AddReference("System.Drawing")
clr.AddReference("System.Windows.Forms.DataVisualization")

import System.Windows.Forms 
from System.Windows.Forms import *
import System.Drawing
from System.Drawing import *
#endregion

#region ___Current doc/app/ui
doc = DocumentManager.Instance.CurrentDBDocument
uiapp = DocumentManager.Instance.CurrentUIApplication
app = uiapp.Application
uidoc = DocumentManager.Instance.CurrentUIApplication.ActiveUIDocument
view = doc.ActiveView
#endregion

#region ___someFunctions
def uwList(input):
    result = input if isinstance(input, list) else [input]
    return UnwrapElement(input)

#endregion


colCollector   = uwList(IN[0])

# Do some action in a Transaction
TransactionManager.Instance.EnsureInTransaction(doc)

# Initialize lists to store filtered columns and material names
filterColums = []

filterNames = []
names = []
for c in colCollector:
    matParam1 = c.get_Parameter(BuiltInParameter.ELEM_FAMILY_PARAM).AsValueString()
    names.append(matParam1)
# filterCol = [c for c in colCollector if 'Concrete' in matName]
# filterColums.append(filterCol)

TransactionManager.Instance.TransactionTaskDone()

OUT = names 
# ----------------------------------------
boolean_2 = BoolSelector(true)
python_script_3 = Python(IN[0]=boolean_2)  # IronPython2
# ---------- python_script_3.python (80 lines) ----------
"""Copyright by: vudinhduybm@gmail.com"""
#region ___import all Library
import clr
import sys 
import System   
import math
import collections

sys.path.append('C:\Program Files\Autodesk\Revit 2022\AddIns\DynamoForRevit\IronPython.StdLib.2.7.9\duynamoLibrary')
from duynamoLibrary import *
clr.AddReference("ProtoGeometry")

from Autodesk.DesignScript.Geometry import *

clr.AddReference("RevitAPI") 
import Autodesk
from Autodesk.Revit.DB import* 
from Autodesk.Revit.DB.Structure import*

clr.AddReference('DSCoreNodes')
from DSCore.List import Flatten

clr.AddReference("RevitAPIUI") 
from Autodesk.Revit.UI import*

clr.AddReference("System") 
from System.Collections.Generic import List

clr.AddReference("RevitNodes")
import Revit
clr.ImportExtensions(Revit.Elements)
clr.ImportExtensions(Revit.GeometryConversion)

clr.AddReference("RevitServices")
import RevitServices
from RevitServices.Persistence import DocumentManager
from RevitServices.Transactions import TransactionManager

clr.AddReference("System.Windows.Forms")
clr.AddReference("System.Drawing")
clr.AddReference("System.Windows.Forms.DataVisualization")

import System.Windows.Forms 
from System.Windows.Forms import *
import System.Drawing
from System.Drawing import *
#endregion

#region ___Current doc/app/ui
doc = DocumentManager.Instance.CurrentDBDocument
uiapp = DocumentManager.Instance.CurrentUIApplication
app = uiapp.Application
uidoc = DocumentManager.Instance.CurrentUIApplication.ActiveUIDocument
view = doc.ActiveView
#endregion

#region ___someFunctions
def uwList(input):
    result = input if isinstance(input, list) else [input]
    return UnwrapElement(input)

#endregion


TransactionManager.Instance.EnsureInTransaction(doc)
cate = BuiltInCategory.OST_StructuralColumns
colCollector = FilteredElementCollector(doc).OfCategory(cate).WhereElementIsElementType()
filteredColumns = []
name = []

for c in colCollector:
    name = c.Family.LookupParameter('Material for Model Behavior').AsValueString()
    if name is not None and 'Concrete' in name :
        filteredColumns.append(c)

baseCol = filteredColumns[0]

TransactionManager.Instance.TransactionTaskDone()

OUT = baseCol 
# ----------------------------------------
python_script_4 = Python(IN[0]=python_script_3)  # IronPython2
# ---------- python_script_4.python (98 lines) ----------
"""Copyright by: vudinhduybm@gmail.com"""
#region ___import all Library
import clr
import sys 
import System   
import math
import collections

sys.path.append('C:\Program Files\Autodesk\Revit 2022\AddIns\DynamoForRevit\IronPython.StdLib.2.7.9\duynamoLibrary')
from duynamoLibrary import *
clr.AddReference("ProtoGeometry")

from Autodesk.DesignScript.Geometry import *

clr.AddReference("RevitAPI") 
import Autodesk
from Autodesk.Revit.DB import* 
from Autodesk.Revit.DB.Structure import*

clr.AddReference('DSCoreNodes')
from DSCore.List import Flatten

clr.AddReference("RevitAPIUI") 
from Autodesk.Revit.UI import*

clr.AddReference("System") 
from System.Collections.Generic import List

clr.AddReference("RevitNodes")
import Revit
clr.ImportExtensions(Revit.Elements)
clr.ImportExtensions(Revit.GeometryConversion)

clr.AddReference("RevitServices")
import RevitServices
from RevitServices.Persistence import DocumentManager
from RevitServices.Transactions import TransactionManager

clr.AddReference("System.Windows.Forms")
clr.AddReference("System.Drawing")
clr.AddReference("System.Windows.Forms.DataVisualization")

import System.Windows.Forms 
from System.Windows.Forms import *
import System.Drawing
from System.Drawing import *
#endregion

#region ___Current doc/app/ui
doc = DocumentManager.Instance.CurrentDBDocument
uiapp = DocumentManager.Instance.CurrentUIApplication
app = uiapp.Application
uidoc = DocumentManager.Instance.CurrentUIApplication.ActiveUIDocument
view = doc.ActiveView
#endregion

#region ___someFunctions
def uwList(input):
    result = input if isinstance(input, list) else [input]
    return UnwrapElement(input)
def duplicateColumns(baseColumn, bList, hList):
    newColumns = []
    sizeList = []
    ss = []
    for b, h in zip(bList, hList):
    	size = "{} x {}mm".format(b, h)
    	sizeList.append(size)
    TransactionManager.Instance.EnsureInTransaction(doc)
    try:
        for b, h, size in zip(bList, hList, sizeList):
            idList = List[ElementId]([c.Id for c in baseColumn])
            copyIds = ElementTransformUtils.CopyElements(doc, idList, doc, Transform.Identity, CopyPasteOptions())
            for id in copyIds:
                newCol = doc.GetElement(id)
                newCol.Name = size
                bParam = newCol.LookupParameter('b')
                hParam = newCol.LookupParameter('h')
                if bParam and hParam:
                    bParam.Set(b/304.8)
                    hParam.Set(h/304.8)
                newColumns.append(newCol)
    except Exception as e:
        pass
    TransactionManager.Instance.TransactionTaskDone()
    return newColumns
#endregion


baseColumn   = [uwList(IN[0])]
bList = uwList(IN[1])
hList = uwList(IN[2])
# Do some action in a Transaction
TransactionManager.Instance.EnsureInTransaction(doc)
cols = duplicateColumns(baseColumn, bList, hList)

TransactionManager.Instance.TransactionTaskDone()

OUT = cols
# ----------------------------------------
code_block_2 = CodeBlock(a=python_script_4) { a; }
