# Dynamo graph VSCode.dyn (Dynamo 2.10.1.3976)
# packages: Duynamo 2022.12.24

boolean = BoolSelector(false)
file_path = Filename("C:\Users\Desktop\Python\02_PyRevit\04_Processing\Test.py")
python_script = Python(IN[0]=boolean, IN[1]=file_path)  # IronPython2
# ---------- python_script.python (5 lines) ----------
re  = open(r"C:\Users\Desktop\Python\02_PyRevit\04_Processing\Test.py", "r")

interpret = re.read()

OUT =  interpret
# ----------------------------------------
pickObjects = Custom[pickObjects](Reset=boolean)  # package Duynamo; from Duynamo to pick Objects
code_block = CodeBlock(x=pickObjects.eleList) { List.Flatten(x); }
code_block_2 = CodeBlock(a=code_block) { a[0]; a[1]; a[2]; }
python_script_from_string = PythonStringNode(script=python_script, IN[0]=code_block_2.out0, IN[1]=code_block_2.out1)  # IronPython2
boolean_2 = BoolSelector(true)
python_script_2 = Python(IN[0]=code_block_2.out0, IN[1]=code_block_2.out1, IN[2]=code_block_2.out2)  # IronPython2
# ---------- python_script_2.python (100 lines) ----------
import clr
import sys 
import System   
import math

clr.AddReference("ProtoGeometry")
from Autodesk.DesignScript.Geometry import *

clr.AddReference("RevitAPI") 
import Autodesk
from Autodesk.Revit.DB import* 
from Autodesk.Revit.DB.Structure import*

clr.AddReference("RevitAPIUI") 
from Autodesk.Revit.UI import*

clr.AddReference("System") 
from System.Collections.Generic import List

clr.AddReference("RevitNodes")
import Revit
clr.ImportExtensions(Revit.Elements)
clr.ImportExtensions(Revit.GeometryConversion)

clr.AddReference("RevitServices")
import RevitServices
from RevitServices.Persistence import DocumentManager
from RevitServices.Transactions import TransactionManager

clr.AddReference("System.Windows.Forms")
clr.AddReference("System.Drawing")
clr.AddReference("System.Windows.Forms.DataVisualization")

import System.Windows.Forms 
from System.Windows.Forms import *
import System.Drawing
from System.Drawing import *
from System.Collections.Generic import List

"""_______________________________________________________________________________________"""
doc = DocumentManager.Instance.CurrentDBDocument
uiapp = DocumentManager.Instance.CurrentUIApplication
app = uiapp.Application
uidoc = DocumentManager.Instance.CurrentUIApplication.ActiveUIDocument
view = doc.ActiveView
"""_____________________________________________________________"""


curve1 = UnwrapElement(IN[0])
curve2 = UnwrapElement(IN[1])
curve3 = UnwrapElement(IN[2])

def closest_connectors(pipe1, pipe2,pipe3):
	conn1 = pipe1.ConnectorManager.Connectors
	conn2 = pipe2.ConnectorManager.Connectors
	conn3 = pipe3.ConnectorManager.Connectors
	
	dist1 = 100000000
	dist2 = 100000000
	connset = []
	for c in conn1:
		for d in conn3:
			conndist = c.Origin.DistanceTo(d.Origin)
			if conndist < dist1:
				dist1 = conndist
				c1 = c
				d1 = d
		for e in conn2:
			conndist = c.Origin.DistanceTo(e.Origin)
			if conndist < dist2:
				dist2 = conndist
				e1 = e
		connset = [c1,d1,e1]
	return connset
	

def newTee(conn1,conn2,conn3):
	fitting = doc.Create.NewTeeFitting(conn1,conn2,conn3)
	return fitting

fittings = []

TransactionManager.Instance.EnsureInTransaction(doc)

		
#shorten new curve


connectors = closest_connectors(curve1,curve2,curve3)

fitting = newTee(connectors[0],connectors[1],connectors[2])
fittings.append(fitting.ToDSType(False))

	
TransactionManager.Instance.TransactionTaskDone()



#Assign your output to the OUT variable.
OUT = fittings
# ----------------------------------------
