# Dynamo graph splitPipe.dyn (Dynamo 2.10.1.3976)
# packages: Genius Loci 2022.4.19

boolean = BoolSelector(true)
file_path = Filename(".\splitPipe.py")  # frozen
python_script = Python(IN[0]=boolean, IN[1]=file_path)  # IronPython2
# ---------- python_script.python (5 lines) ----------
re  = open(r"C:\Users\Desktop\Python\02_PyRevit\04_Processing\01_pyRevitAPI\splitPipe.py", "r")

interpret = re.read()

OUT =  interpret
# ----------------------------------------
python_script_from_string = PythonStringNode(script=python_script)  # IronPython2
boolean_2 = BoolSelector(true)
python_script_2 = Python(IN[0]=boolean_2)  # IronPython2
# ---------- python_script_2.python (82 lines) ----------
"""Copyright by: vudinhduybm@gmail.com"""
#region ___import all Library
import clr
import sys 
import System   
import math
import collections

clr.AddReference("ProtoGeometry")

from Autodesk.DesignScript.Geometry import *

clr.AddReference("RevitAPI") 
import Autodesk
from Autodesk.Revit.DB import* 
from Autodesk.Revit.DB.Structure import*

clr.AddReference("RevitAPIUI") 
from Autodesk.Revit.UI import*
from Autodesk.Revit.UI.Selection import ISelectionFilter
clr.AddReference("System") 
from System.Collections.Generic import List

clr.AddReference("RevitNodes")
import Revit
clr.ImportExtensions(Revit.Elements)
clr.ImportExtensions(Revit.GeometryConversion)

clr.AddReference("RevitServices")
import RevitServices
from RevitServices.Persistence import DocumentManager
from RevitServices.Transactions import TransactionManager

clr.AddReference("System.Windows.Forms")
clr.AddReference("System.Drawing")
clr.AddReference("System.Windows.Forms.DataVisualization")

import System.Windows.Forms 
from System.Windows.Forms import *
import System.Drawing
from System.Drawing import *
#endregion

#region ___Current doc/app/ui
doc = DocumentManager.Instance.CurrentDBDocument
uiapp = DocumentManager.Instance.CurrentUIApplication
app = uiapp.Application
uidoc = DocumentManager.Instance.CurrentUIApplication.ActiveUIDocument
view = doc.ActiveView
#endregion

#region ___someFunctions
def uwList(input):
    result = input if isinstance(input, list) else [input]
    return UnwrapElement(input)
class selectionFilter(ISelectionFilter):
	def __init__(self, category):
		self.category = category
	def AllowElement(self, element):
		if element.Category.Name == self.category:
			return True
		else:
			return False
def pickPipe():
	pipes = []
	pipeFilter = selectionFilter("Pipes")
	pipeRef = uidoc.Selection.PickObject(Autodesk.Revit.UI.Selection.ObjectType.Element, pipeFilter,"pick Pipes")
	pipe = doc.GetElement(pipeRef.ElementId)
	return pipe	
	
#endregion


eleList   = uwList(IN[0])

# Do some action in a Transaction
TransactionManager.Instance.EnsureInTransaction(doc)
pipe = pickPipe()

TransactionManager.Instance.TransactionTaskDone()

OUT = pipe
# ----------------------------------------
code_block = CodeBlock(a=python_script_2) { a; }
python_script_3 = Python(IN[0]=code_block)  # IronPython2; frozen
# ---------- python_script_3.python (119 lines) ----------
"""Copyright by: vudinhduybm@gmail.com"""
#region ___import all Library
import clr
import sys 
import System   
import math
import collections

from math import cos,sin,tan,radians

clr.AddReference("ProtoGeometry")
from Autodesk.DesignScript.Geometry import *

clr.AddReference("RevitAPI") 
import Autodesk
from Autodesk.Revit.DB import* 
from Autodesk.Revit.DB.Structure import*
from Autodesk.Revit.DB.Plumbing import*

clr.AddReference("RevitAPIUI") 
from Autodesk.Revit.UI import*
from Autodesk.Revit.UI.Selection import ISelectionFilter
clr.AddReference("System") 
from System.Collections.Generic import List

clr.AddReference("RevitNodes")
import Revit
clr.ImportExtensions(Revit.Elements)
clr.ImportExtensions(Revit.GeometryConversion)

clr.AddReference("RevitServices")
import RevitServices
from RevitServices.Persistence import DocumentManager
from RevitServices.Transactions import TransactionManager

clr.AddReference("System.Windows.Forms")
clr.AddReference("System.Drawing")
clr.AddReference("System.Windows.Forms.DataVisualization")

import System.Windows.Forms 
from System.Windows.Forms import *
import System.Drawing
from System.Drawing import *
#endregion

#region ___Current doc/app/ui
doc = DocumentManager.Instance.CurrentDBDocument
uiapp = DocumentManager.Instance.CurrentUIApplication
app = uiapp.Application
uidoc = DocumentManager.Instance.CurrentUIApplication.ActiveUIDocument
view = doc.ActiveView
#endregion

#region ___someFunctions
def uwList(input):
    result = input if isinstance(input, list) else [input]
    return UnwrapElement(input)
def flatten(nestedList):
    flatList = []
    for item in nestedList:
        if isinstance(item, list):
            flatList.extend(flatten(item))
        else:
            flatList.append(item)
    return flatList

def divideLineSegment(doc, pipe, pointA, LengthA):
    TransactionManager.Instance.EnsureInTransaction(doc)
    lineSegment = pipe.Location.Curve
    start_point = lineSegment.GetEndPoint(0)
    end_point = lineSegment.GetEndPoint(1)
    vector = end_point - start_point
    total_length = vector.GetLength()*304.8
    direction = vector.Normalize()
    num_segments = int(total_length / LengthA)
    points = []
    desPoints =[]
    current_point = pointA
    for i in range(num_segments + 1):
        points.append(current_point)
        desPoints.append(current_point)
    TransactionManager.Instance.TransactionTaskDone()
    return desPoints
def splitPipeAtPoints(doc, pipe, points):
    newPipes = []
    points = sorted(points, key=lambda p: (pipe.Location.Curve.GetEndPoint(0) - p).DotProduct(pipe.Location.Curve.Direction))

    for point in points:
        pipeLocation = pipe.Location
        if isinstance(pipeLocation, LocationCurve):
            pipeCurve = pipeLocation.Curve
            if pipeCurve is not None:
                newPipeIds = PlumbingUtils.BreakCurve(doc, pipe.Id, point)
                for id in newPipeIds:
                    newPipes.append(doc.GetElement(id))
    return newPipes
def remove_first_and_last_items(lst):
    # Check if the list has more than two elements
    if len(lst) > 2:
        return lst[1:-1]
    else:
        # If the list has two or fewer elements, return an empty list
        return []
#endregion
pipe   = UnwrapElement(IN[0])
splLength = 1000
# Do some action in a Transaction
TransactionManager.Instance.EnsureInTransaction(doc)
pipeCurve = pipe.Location.Curve
conns = list(pipe.ConnectorManager.Connectors.GetEnumerator())
orgiginConns = list(c.Origin for c in conns)
sortConns = sorted(orgiginConns, key=lambda c : c.Y)
splitPoints = divideLineSegment(doc, pipe, sortConns[0], splLength)
lst = list(c for c in splitPoints)
#splitPipe = splitPipeAtPoints(doc, pipe, splitPoints)

TransactionManager.Instance.TransactionTaskDone()

OUT = lst
# ----------------------------------------
split_bypoints = Custom[Split ByPoints](element=code_block@L1, point=python_script_3)  # package Genius Loci; Split linear elements by points (duct, pipe, column, beam and wall). As many elements as points are required. Works only in Revit 2017 and later.
python_script_4 = Python(IN[0]=code_block)  # IronPython2; frozen
# ---------- python_script_4.python (110 lines) ----------
"""Copyright by: vudinhduybm@gmail.com"""
#region ___import all Library
import clr
import sys 
import System   
import math
import collections

from math import cos,sin,tan,radians

clr.AddReference("ProtoGeometry")
from Autodesk.DesignScript.Geometry import *

clr.AddReference("RevitAPI") 
import Autodesk
from Autodesk.Revit.DB import* 
from Autodesk.Revit.DB.Structure import*
from Autodesk.Revit.DB.Plumbing import*

clr.AddReference("RevitAPIUI") 
from Autodesk.Revit.UI import*
from Autodesk.Revit.UI.Selection import ISelectionFilter
clr.AddReference("System") 
from System.Collections.Generic import List

clr.AddReference("RevitNodes")
import Revit
clr.ImportExtensions(Revit.Elements)
clr.ImportExtensions(Revit.GeometryConversion)

clr.AddReference("RevitServices")
import RevitServices
from RevitServices.Persistence import DocumentManager
from RevitServices.Transactions import TransactionManager

clr.AddReference("System.Windows.Forms")
clr.AddReference("System.Drawing")
clr.AddReference("System.Windows.Forms.DataVisualization")

import System.Windows.Forms 
from System.Windows.Forms import *
import System.Drawing
from System.Drawing import *
#endregion

#region ___Current doc/app/ui
doc = DocumentManager.Instance.CurrentDBDocument
uiapp = DocumentManager.Instance.CurrentUIApplication
app = uiapp.Application
uidoc = DocumentManager.Instance.CurrentUIApplication.ActiveUIDocument
view = doc.ActiveView
#endregion

#region ___someFunctions
def uwList(input):
    result = input if isinstance(input, list) else [input]
    return UnwrapElement(input)
def flatten(nestedList):
    flatList = []
    for item in nestedList:
        if isinstance(item, list):
            flatList.extend(flatten(item))
        else:
            flatList.append(item)
    return flatList

def divideLineSegment(doc, pipe, pointA, LengthA):
    lineSegment = pipe.Location.Curve
    start_point = lineSegment.GetEndPoint(0)
    end_point = lineSegment.GetEndPoint(1)
    vector = end_point - start_point
    total_length = vector.GetLength() * 304.8
    direction = vector.Normalize()
    num_segments = int(total_length / LengthA)
    points = []
    current_point = pointA
    for i in range(num_segments):
        points.append(current_point)
        current_point = current_point + direction.Multiply(LengthA / 304.8)
    return points

def splitPipeAtPoints(doc, pipe, points):
    newPipes = []
    points = sorted(points, key=lambda p: (pipe.Location.Curve.GetEndPoint(0) - p).DotProduct(pipe.Location.Curve.Direction))
    for point in points:
        pipeLocation = pipe.Location
        if isinstance(pipeLocation, LocationCurve):
            pipeCurve = pipeLocation.Curve
            if pipeCurve is not None:
                newPipeIds = PlumbingUtils.BreakCurve(doc, pipe.Id, point)
                for id in newPipeIds:
                    newPipes.append(doc.GetElement(id))
    return newPipes

#endregion

pipe = UnwrapElement(IN[0])
splLength = 1000

# Do some action in a Transaction
TransactionManager.Instance.EnsureInTransaction(doc)
pipeCurve = pipe.Location.Curve
conns = list(pipe.ConnectorManager.Connectors.GetEnumerator())
orgiginConns = list(c.Origin for c in conns)
sortConns = sorted(orgiginConns, key=lambda c: c.Y)
splitPoints = divideLineSegment(doc, pipe, sortConns[0], splLength)
splitPipe = splitPipeAtPoints(doc, pipe, splitPoints)
TransactionManager.Instance.TransactionTaskDone()

OUT = splitPoints, splitPipe
# ----------------------------------------
split_point_ok = Python(IN[0]=code_block)  # IronPython2
# ---------- split_point_ok.python (189 lines) ----------
"""Copyright by: vudinhduybm@gmail.com"""
#region ___import all Library
import clr
import sys 
import System   
import math
import collections

from math import cos,sin,tan,radians

clr.AddReference("ProtoGeometry")
from Autodesk.DesignScript.Geometry import *

clr.AddReference("RevitAPI") 
import Autodesk
from Autodesk.Revit.DB import* 
from Autodesk.Revit.DB.Structure import*
from Autodesk.Revit.DB.Plumbing import*

clr.AddReference("RevitAPIUI") 
from Autodesk.Revit.UI import*
from Autodesk.Revit.UI.Selection import ISelectionFilter
clr.AddReference("System") 
from System.Collections.Generic import List

clr.AddReference("RevitNodes")
import Revit
clr.ImportExtensions(Revit.Elements)
clr.ImportExtensions(Revit.GeometryConversion)

clr.AddReference("RevitServices")
import RevitServices
from RevitServices.Persistence import DocumentManager
from RevitServices.Transactions import TransactionManager

clr.AddReference("System.Windows.Forms")
clr.AddReference("System.Drawing")
clr.AddReference("System.Windows.Forms.DataVisualization")

import System.Windows.Forms 
from System.Windows.Forms import *
import System.Drawing
from System.Drawing import *
#endregion

#region ___Current doc/app/ui
doc = DocumentManager.Instance.CurrentDBDocument
uiapp = DocumentManager.Instance.CurrentUIApplication
app = uiapp.Application
uidoc = DocumentManager.Instance.CurrentUIApplication.ActiveUIDocument
view = doc.ActiveView
#endregion

#region ___someFunctions
def uwList(input):
    result = input if isinstance(input, list) else [input]
    return UnwrapElement(input)
def flatten(nestedList):
    flatList = []
    for item in nestedList:
        if isinstance(item, list):
            flatList.extend(flatten(item))
        else:
            flatList.append(item)
    return flatList

def divideLineSegment(doc, pipe, pointA, LengthA):
    TransactionManager.Instance.EnsureInTransaction(doc)
    lineSegment = pipe.Location.Curve
    start_point = lineSegment.GetEndPoint(0)
    end_point = lineSegment.GetEndPoint(1)
    vector = end_point - start_point
    total_length = vector.GetLength()*304.8
    direction = vector.Normalize()
    num_segments = int(total_length / LengthA)
    points = []
    desPoints =[]
    current_point = pointA
    for i in range(num_segments + 1):
        points.append(current_point)
        desPoints.append(current_point)
    TransactionManager.Instance.TransactionTaskDone()
    return desPoints
def splitPipeAtPoints(doc, pipe, points):
    newPipes = []
    points = sorted(points, key=lambda p: (pipe.Location.Curve.GetEndPoint(0) - p).DotProduct(pipe.Location.Curve.Direction))

    for point in points:
        pipeLocation = pipe.Location
        if isinstance(pipeLocation, LocationCurve):
            pipeCurve = pipeLocation.Curve
            if pipeCurve is not None:
                newPipeIds = PlumbingUtils.BreakCurve(doc, pipe.Id, point)
                for id in newPipeIds:
                    newPipes.append(doc.GetElement(id))
    return newPipes
def divideLineSegment(line, length, startPoint, endPoint):
    # Initialize the list of points
    points = []
    # Calculate the total length of the line
    total_length = line.Length
    # Calculate the direction vector of the line
    direction = (endPoint - startPoint).Normalize()
    # Initialize the current point to the start point
    current_point = startPoint

    # Add the start point to the list of points
    points.append(current_point)

    # Loop to add points at intervals of 'length'
    while (current_point.DistanceTo(startPoint) + length) <= total_length:
        # Calculate the next point
        current_point = current_point + direction * length

        # Add the next point to the list of points
        points.append(current_point.ToPoint())

    return points
#endregion
pipe   = UnwrapElement(IN[0])
splLength = 1000/304.8
# Do some action in a Transaction
TransactionManager.Instance.EnsureInTransaction(doc)
pipeCurve = pipe.Location.Curve
conns = list(pipe.ConnectorManager.Connectors.GetEnumerator())
orgiginConns = list(c.Origin for c in conns)
sortConns = sorted(orgiginConns, key=lambda c : c.Y)
#splitPoints = divideLineSegment(doc, pipe, sortConns[0], splLength)
#lst = list(c for c in splitPoints)
#splitPipe = splitPipeAtPoints(doc, pipe, splitPoints)

points = divideLineSegment(pipeCurve, splLength,sortConns[0], sortConns[1])

parents,childs,fittings = [],[],[]
children = {}

TransactionManager.Instance.EnsureInTransaction(doc)
for e, p in zip(pipe,points):
	to_check = [e]
	if e.Id in children:
		to_check.extend(children[e.Id])
		
	splitId = None
	for ec in to_check:
		if isinstance(ec,Autodesk.Revit.DB.Plumbing.Pipe):
			try:
				splitId = Autodesk.Revit.DB.Plumbing.PlumbingUtils.BreakCurve(doc, ec.Id, p)
				break
			except:
				pass				
		elif isinstance(ec,Autodesk.Revit.DB.Mechanical.Duct):
			try:
				splitId = Autodesk.Revit.DB.Mechanical.MechanicalUtils.BreakCurve(doc, ec.Id, p)
				break
			except:
				pass
	if splitId:
		split = doc.GetElement(splitId)
		if hasattr(split,"ConnectorManager"):
			newPipeConnectors = split.ConnectorManager.Connectors
			#Check
			connA = None
			connB = None
			for c in ec.ConnectorManager.Connectors:
				pc = c.Origin
				#get connectorB near to connectorA
				nearest = [x for x in newPipeConnectors if pc.DistanceTo(x.Origin) < 0.01]
				#If exists assign
				if nearest:
					connA = c
					connB = nearest[0]
			#Create fitting
			try:
				fittings.append(doc.Create.NewUnionFitting(connA, connB))
			except:pass
		
		if e.Id in children:
			children[e.Id].append(split)
		else:
			children[e.Id] = [split]
		parents.append(ec)
		childs.append(split)
	else:
		parents.append(None)
		childs.append(None)
TransactionManager.Instance.TransactionTaskDone()
TransactionManager.Instance.TransactionTaskDone()

OUT = parents,childs,fittings
# ----------------------------------------
split_point_ok_2 = Python(IN[0]=code_block)  # IronPython2
# ---------- split_point_ok_2.python (136 lines) ----------
"""Copyright by: vudinhduybm@gmail.com"""
#region ___import all Library
import clr
import sys 
import System   
import math
import collections

from math import cos,sin,tan,radians

clr.AddReference("ProtoGeometry")
from Autodesk.DesignScript.Geometry import *

clr.AddReference("RevitAPI") 
import Autodesk
from Autodesk.Revit.DB import* 
from Autodesk.Revit.DB.Structure import*
from Autodesk.Revit.DB.Plumbing import*

clr.AddReference("RevitAPIUI") 
from Autodesk.Revit.UI import*
from Autodesk.Revit.UI.Selection import ISelectionFilter
clr.AddReference("System") 
from System.Collections.Generic import List

clr.AddReference("RevitNodes")
import Revit
clr.ImportExtensions(Revit.Elements)
clr.ImportExtensions(Revit.GeometryConversion)

clr.AddReference("RevitServices")
import RevitServices
from RevitServices.Persistence import DocumentManager
from RevitServices.Transactions import TransactionManager

clr.AddReference("System.Windows.Forms")
clr.AddReference("System.Drawing")
clr.AddReference("System.Windows.Forms.DataVisualization")

import System.Windows.Forms 
from System.Windows.Forms import *
import System.Drawing
from System.Drawing import *
#endregion

#region ___Current doc/app/ui
doc = DocumentManager.Instance.CurrentDBDocument
uiapp = DocumentManager.Instance.CurrentUIApplication
app = uiapp.Application
uidoc = DocumentManager.Instance.CurrentUIApplication.ActiveUIDocument
view = doc.ActiveView
#endregion

#region ___someFunctions
def uwList(input):
    result = input if isinstance(input, list) else [input]
    return UnwrapElement(input)
def flatten(nestedList):
    flatList = []
    for item in nestedList:
        if isinstance(item, list):
            flatList.extend(flatten(item))
        else:
            flatList.append(item)
    return flatList

def divideLineSegment(doc, pipe, pointA, LengthA):
    TransactionManager.Instance.EnsureInTransaction(doc)
    lineSegment = pipe.Location.Curve
    start_point = lineSegment.GetEndPoint(0)
    end_point = lineSegment.GetEndPoint(1)
    vector = end_point - start_point
    total_length = vector.GetLength()*304.8
    direction = vector.Normalize()
    num_segments = int(total_length / LengthA)
    points = []
    desPoints =[]
    current_point = pointA
    for i in range(num_segments + 1):
        points.append(current_point)
        desPoints.append(current_point)
    TransactionManager.Instance.TransactionTaskDone()
    return desPoints
def splitPipeAtPoints(doc, pipe, points):
    newPipes = []
    points = sorted(points, key=lambda p: (pipe.Location.Curve.GetEndPoint(0) - p).DotProduct(pipe.Location.Curve.Direction))

    for point in points:
        pipeLocation = pipe.Location
        if isinstance(pipeLocation, LocationCurve):
            pipeCurve = pipeLocation.Curve
            if pipeCurve is not None:
                newPipeIds = PlumbingUtils.BreakCurve(doc, pipe.Id, point)
                for id in newPipeIds:
                    newPipes.append(doc.GetElement(id))
    return newPipes
def divideLineSegment(line, length, startPoint, endPoint):
    # Initialize the list of points
    points = []
    # Calculate the total length of the line
    total_length = line.Length
    # Calculate the direction vector of the line
    direction = (endPoint - startPoint).Normalize()
    # Initialize the current point to the start point
    current_point = startPoint

    # Add the start point to the list of points
    points.append(current_point)

    # Loop to add points at intervals of 'length'
    while (current_point.DistanceTo(startPoint) + length) <= total_length:
        # Calculate the next point
        current_point = current_point + direction * length

        # Add the next point to the list of points
        points.append(current_point.ToPoint())

    return points
#endregion
pipe   = UnwrapElement(IN[0])
splLength = 1000/304.8
# Do some action in a Transaction
TransactionManager.Instance.EnsureInTransaction(doc)
pipeCurve = pipe.Location.Curve
conns = list(pipe.ConnectorManager.Connectors.GetEnumerator())
orgiginConns = list(c.Origin for c in conns)
sortConns = sorted(orgiginConns, key=lambda c : c.Y)
#splitPoints = divideLineSegment(doc, pipe, sortConns[0], splLength)
#lst = list(c for c in splitPoints)
#splitPipe = splitPipeAtPoints(doc, pipe, splitPoints)

points = divideLineSegment(pipeCurve, splLength,sortConns[0], sortConns[1])

TransactionManager.Instance.TransactionTaskDone()

OUT = points
# ----------------------------------------
python_script_5 = Python()  # IronPython2; unwired: IN[0], IN[1]
# ---------- python_script_5.python (141 lines) ----------
#Thanks to Maciek Glowka and Cyril Poupin on the Dynamo Forum

import clr
clr.AddReference('RevitAPI')
import Autodesk
from Autodesk.Revit.DB import *

clr.AddReference('RevitServices')
import RevitServices
from RevitServices.Persistence import DocumentManager
from RevitServices.Transactions import TransactionManager

clr.AddReference('RevitNodes')
import Revit
clr.ImportExtensions(Revit.GeometryConversion)
doc = DocumentManager.Instance.CurrentDBDocument

elements = UnwrapElement(IN[0]) if isinstance(IN[0],list) else [UnwrapElement(IN[0])]
points = IN[1] if isinstance(IN[1],list) else [IN[1]]
points = [p.ToXyz() for p in points]

parents,childs,fittings = [],[],[]
children = {}

def colCurve(col):	
	loc= col.Location.Point
	bb = col.get_BoundingBox(None).Min
	height=col.get_Parameter(BuiltInParameter.INSTANCE_LENGTH_PARAM).AsDouble()
	start=XYZ(loc.X,loc.Y,bb.Z)
	end=XYZ(start.X,start.Y,start.Z+height)
	curve=Line.CreateBound(start,end)
	return curve

def pointOnLine(p,a,b):
	if not (p-a).CrossProduct(b-a).IsAlmostEqualTo(XYZ.Zero):
		return False
	if a.X!=b.X:
		if a.X<p.X<b.X:
			return True
		if a.X>p.X>b.X:
			return True
	else:
		if a.Y<p.Y<b.Y:
			return True
		if a.Y>p.Y>b.Y:
			return True
	return False
	
def splitWall(ec,p):
	lc = ec.Location.Curve
	v0 = lc.GetEndPoint(0)
	v1 = lc.GetEndPoint(1)
	isOnLine=False
	if pointOnLine(p,v0,v1):
		isOnLine = True
	if isOnLine:
		join_1 = WallUtils.IsWallJoinAllowedAtEnd(ec, 1)
		WallUtils.DisallowWallJoinAtEnd(ec, 1)
		e1Id=ElementTransformUtils.CopyElement(doc, ec.Id, XYZ.Zero)[0]
		e1 = doc.GetElement(e1Id)
		WallUtils.DisallowWallJoinAtEnd(e1, 0)
		nc0 = Autodesk.Revit.DB.Line.CreateBound(v0, p)
		nc1 = Autodesk.Revit.DB.Line.CreateBound(v1, p)
		ec.Location.Curve = nc0
		e1.Location.Curve = nc1
		if join_1 :
			WallUtils.DisallowWallJoinAtEnd(e1, 0)
		WallUtils.AllowWallJoinAtEnd(ec, 1)
		WallUtils.AllowWallJoinAtEnd(e1, 0)
	return e1Id

TransactionManager.Instance.EnsureInTransaction(doc)
for e, p in zip(elements,points):
	to_check = [e]
	if e.Id in children:
		to_check.extend(children[e.Id])
		
	splitId = None
	for ec in to_check:
		if isinstance(ec,Autodesk.Revit.DB.Plumbing.Pipe):
			try:
				splitId = Autodesk.Revit.DB.Plumbing.PlumbingUtils.BreakCurve(doc, ec.Id, p)
				break
			except:
				pass				
		elif isinstance(ec,Autodesk.Revit.DB.Mechanical.Duct):
			try:
				splitId = Autodesk.Revit.DB.Mechanical.MechanicalUtils.BreakCurve(doc, ec.Id, p)
				break
			except:
				pass
		elif isinstance(ec,Autodesk.Revit.DB.FamilyInstance) and ec.CanSplit :
			try:
				if ec.Location.ToString() == 'Autodesk.Revit.DB.LocationCurve':
					curvB = ec.Location.Curve
				elif ElementId(BuiltInCategory.OST_StructuralColumns) == ec.Category.Id and not ec.IsSlantedColumn :
					curvB = colCurve(ec)
				lenBeam = curvB.Length 
				param = (curvB.GetEndPoint(0).DistanceTo(p)) / lenBeam
				splitId = ec.Split(param)
				break
			except:
				pass
		elif isinstance(ec,Autodesk.Revit.DB.Wall):
			try:
				splitId = splitWall(ec,p)
				break
			except:
				pass
	if splitId:
		split = doc.GetElement(splitId)
		if hasattr(split,"ConnectorManager"):
			newPipeConnectors = split.ConnectorManager.Connectors
			#Check
			connA = None
			connB = None
			for c in ec.ConnectorManager.Connectors:
				pc = c.Origin
				#get connectorB near to connectorA
				nearest = [x for x in newPipeConnectors if pc.DistanceTo(x.Origin) < 0.01]
				#If exists assign
				if nearest:
					connA = c
					connB = nearest[0]
			#Create fitting
			try:
				fittings.append(doc.Create.NewUnionFitting(connA, connB))
			except:pass
		
		if e.Id in children:
			children[e.Id].append(split)
		else:
			children[e.Id] = [split]
		parents.append(ec)
		childs.append(split)
	else:
		parents.append(None)
		childs.append(None)
TransactionManager.Instance.TransactionTaskDone()
			
OUT = parents,childs,fittings
# ----------------------------------------
