# Dynamo graph PipeCreate.dyn (Dynamo 2.10.1.3976)
# packages: Duynamo 2022.12.24, MEPover 2022.10.30

boolean = BoolSelector(false)
file_path = Filename("..\PipeCreate.py")
python_script = Python(IN[0]=boolean, IN[1]=file_path)  # IronPython2
# ---------- python_script.python (5 lines) ----------
re  = open(r"C:\Users\95053\Desktop\Python\RevitAPI-master\RevitAPI\PipeCreate.py", "r")

interpret = re.read()

OUT =  interpret
# ----------------------------------------
python_script_from_string = PythonStringNode(script=python_script)  # IronPython2; unwired: IN[0]
boolean_2 = BoolSelector(true)  # frozen
file_path_2 = Filename("..\clickButton.py")
python_script_2 = Python(IN[0]=boolean_2, IN[1]=file_path_2)  # IronPython2
# ---------- python_script_2.python (5 lines) ----------
re  = open(r"C:\Users\95053\Desktop\Python\RevitAPI-master\RevitAPI\\clickButton.py", "r")

interpret = re.read()

OUT =  interpret
# ----------------------------------------
boolean_3 = BoolSelector(true)
python_script_from_string_2 = PythonStringNode(script=python_script_2, IN[0]=boolean_3)  # IronPython2
python_script_3 = Python()  # IronPython2; frozen; unwired: IN[0]
# ---------- python_script_3.python (345 lines) ----------
import clr
import sys 
import System   
clr.AddReference("ProtoGeometry")
from Autodesk.DesignScript.Geometry import *

clr.AddReference("RevitAPI") 
from Autodesk.Revit.DB import*
from Autodesk.Revit.DB.Structure import*

clr.AddReference("RevitAPIUI") 
from Autodesk.Revit.UI import*

clr.AddReference("System") 
from System.Collections.Generic import List

clr.AddReference("RevitNodes")
import Revit
clr.ImportExtensions(Revit.Elements)
clr.ImportExtensions(Revit.GeometryConversion)

clr.AddReference("RevitServices")
import RevitServices
from RevitServices.Persistence import DocumentManager
from RevitServices.Transactions import TransactionManager

clr.AddReference("System.Windows.Forms")
clr.AddReference("System.Drawing")
clr.AddReference("System.Windows.Forms.DataVisualization")

import System.Windows.Forms 
from System.Windows.Forms import *
import System.Drawing
from System.Drawing import *


doc = DocumentManager.Instance.CurrentDBDocument
uiapp = DocumentManager.Instance.CurrentUIApplication
app = uiapp.Application
uidoc = DocumentManager.Instance.CurrentUIApplication.ActiveUIDocument
view = doc.ActiveView



def getAllPipingSystems(doc):
	collector = FilteredElementCollector(doc, view.Id).OfCategory(BuiltInCategory.OST_PipingSystem)
	pipingSystems = collector.ToElements()
	pipingSystemsName = []
	for system in pipingSystems:
		systemName = system.get_Parameter(BuiltInParameter.SYMBOL_NAME_PARAM).AsString()
		pipingSystemsName.append(systemName)
	return pipingSystemsName

pipingSystemsCollector = getAllPipingSystems(doc)

def getAllPipeTypes(doc):
	collector1 = FilteredElementCollector(doc, view.Id).OfCategory(BuiltInCategory.OST_PipeCurves)
	pipeTypes = collector1.ToElements()
	pipeTypesName = []
	for pipeType in pipeTypes:
		pipeTypeName = pipeType.get_Parameter(BuiltInParameter.SYMBOL_NAME_PARAM).AsString()
		pipeTypesName.append(pipeTypeName)
	return pipeTypesName

pipeTypesCollector = getAllPipeTypes(doc)

levelsCollector = FilteredElementCollector(doc).OfClass(Level).ToElements()
levelsNameCollector = []
for level in levelsCollector:
	levelName = level.Name
	levelsNameCollector.append(levelName)

class MainForm(Form):
	def __init__(self):
		self.InitializeComponent()
	
	def InitializeComponent(self):
		self._groupBox1 = System.Windows.Forms.GroupBox()
		self._button1 = System.Windows.Forms.Button()
		self._button2 = System.Windows.Forms.Button()
		self._comboBox1 = System.Windows.Forms.ComboBox()
		self._label1 = System.Windows.Forms.Label()
		self._groupBox2 = System.Windows.Forms.GroupBox()
		self._label2 = System.Windows.Forms.Label()
		self._comboBox2 = System.Windows.Forms.ComboBox()
		self._groupBox3 = System.Windows.Forms.GroupBox()
		self._label3 = System.Windows.Forms.Label()
		self._comboBox3 = System.Windows.Forms.ComboBox()
		self._groupBox4 = System.Windows.Forms.GroupBox()
		self._label4 = System.Windows.Forms.Label()
		self._textBox1 = System.Windows.Forms.TextBox()
		self._button3 = System.Windows.Forms.Button()
		self._button4 = System.Windows.Forms.Button()
		self._label5 = System.Windows.Forms.Label()
		self._groupBox1.SuspendLayout()
		self._groupBox2.SuspendLayout()
		self._groupBox3.SuspendLayout()
		self._groupBox4.SuspendLayout()
		self.SuspendLayout()
		# 
		# groupBox1
		# 
		self._groupBox1.Controls.Add(self._label1)
		self._groupBox1.Controls.Add(self._comboBox1)
		self._groupBox1.Location = System.Drawing.Point(12, 159)
		self._groupBox1.Name = "groupBox1"
		self._groupBox1.Size = System.Drawing.Size(449, 47)
		self._groupBox1.TabIndex = 0
		self._groupBox1.TabStop = False
		# 
		# button1
		# 
		self._button1.BackColor = System.Drawing.SystemColors.Info
		self._button1.Font = System.Drawing.Font("MS UI Gothic", 10, System.Drawing.FontStyle.Bold | System.Drawing.FontStyle.Underline, System.Drawing.GraphicsUnit.Point, 128, True)
		self._button1.ForeColor = System.Drawing.Color.Red
		self._button1.Location = System.Drawing.Point(52, 28)
		self._button1.Name = "button1"
		self._button1.Size = System.Drawing.Size(140, 58)
		self._button1.TabIndex = 1
		self._button1.Text = "get X,Y value"
		self._button1.UseVisualStyleBackColor = False
		# 
		# button2
		# 
		self._button2.BackColor = System.Drawing.SystemColors.Info
		self._button2.Cursor = System.Windows.Forms.Cursors.AppStarting
		self._button2.Font = System.Drawing.Font("MS UI Gothic", 10, System.Drawing.FontStyle.Bold | System.Drawing.FontStyle.Underline, System.Drawing.GraphicsUnit.Point, 128, True)
		self._button2.ForeColor = System.Drawing.Color.Red
		self._button2.Location = System.Drawing.Point(279, 28)
		self._button2.Name = "button2"
		self._button2.Size = System.Drawing.Size(140, 58)
		self._button2.TabIndex = 2
		self._button2.Text = "get Z value"
		self._button2.UseVisualStyleBackColor = False
		# 
		# comboBox1
		# 
		self._comboBox1.AllowDrop = True
		self._comboBox1.Cursor = System.Windows.Forms.Cursors.AppStarting
		self._comboBox1.FormattingEnabled = True
		self._comboBox1.Location = System.Drawing.Point(180, 12)
		self._comboBox1.Name = "comboBox1"
		self._comboBox1.Size = System.Drawing.Size(263, 23)
		self._comboBox1.TabIndex = 3
		self._comboBox1.SelectedIndexChanged += self.ComboBox1_SelectedIndexChanged
		self._comboBox1.Items.AddRange(System.Array[System.Object](pipingSystemsCollector))

		# 
		# label1
		# 
		self._label1.BackColor = System.Drawing.SystemColors.Info
		self._label1.BorderStyle = System.Windows.Forms.BorderStyle.Fixed3D
		self._label1.Font = System.Drawing.Font("MS UI Gothic", 9, System.Drawing.FontStyle.Bold, System.Drawing.GraphicsUnit.Point, 128)
		self._label1.ForeColor = System.Drawing.Color.Blue
		self._label1.Location = System.Drawing.Point(19, 12)
		self._label1.Name = "label1"
		self._label1.Size = System.Drawing.Size(142, 23)
		self._label1.TabIndex = 4
		self._label1.Text = "PipingSystemType"
		# 
		# groupBox2
		# 
		self._groupBox2.Controls.Add(self._label2)
		self._groupBox2.Controls.Add(self._comboBox2)
		self._groupBox2.Location = System.Drawing.Point(12, 212)
		self._groupBox2.Name = "groupBox2"
		self._groupBox2.Size = System.Drawing.Size(449, 47)
		self._groupBox2.TabIndex = 5
		self._groupBox2.TabStop = False
		# 
		# label2
		# 
		self._label2.BackColor = System.Drawing.SystemColors.Info
		self._label2.BorderStyle = System.Windows.Forms.BorderStyle.Fixed3D
		self._label2.Font = System.Drawing.Font("MS UI Gothic", 9, System.Drawing.FontStyle.Bold, System.Drawing.GraphicsUnit.Point, 128)
		self._label2.ForeColor = System.Drawing.Color.Blue
		self._label2.Location = System.Drawing.Point(19, 12)
		self._label2.Name = "label2"
		self._label2.Size = System.Drawing.Size(142, 23)
		self._label2.TabIndex = 4
		self._label2.Text = "PipeType"
		self._label2.Click += self.Label2Click
		# 
		# comboBox2
		# 
		self._comboBox2.AllowDrop = True
		self._comboBox2.Cursor = System.Windows.Forms.Cursors.AppStarting
		self._comboBox2.FormattingEnabled = True
		self._comboBox2.Location = System.Drawing.Point(180, 12)
		self._comboBox2.Name = "comboBox2"
		self._comboBox2.Size = System.Drawing.Size(263, 23)
		self._comboBox2.TabIndex = 3
		self._comboBox2.SelectedIndexChanged += self.ComboBox2_SelectedIndexChanged
		self._comboBox2.Items.AddRange(System.Array[System.Object](pipeTypesCollector))		
		# 
		# groupBox3
		# 
		self._groupBox3.Controls.Add(self._label3)
		self._groupBox3.Controls.Add(self._comboBox3)
		self._groupBox3.Location = System.Drawing.Point(12, 265)
		self._groupBox3.Name = "groupBox3"
		self._groupBox3.Size = System.Drawing.Size(449, 47)
		self._groupBox3.TabIndex = 6
		self._groupBox3.TabStop = False
		# 
		# label3
		# 
		self._label3.BackColor = System.Drawing.SystemColors.Info
		self._label3.BorderStyle = System.Windows.Forms.BorderStyle.Fixed3D
		self._label3.Font = System.Drawing.Font("MS UI Gothic", 9, System.Drawing.FontStyle.Bold, System.Drawing.GraphicsUnit.Point, 128)
		self._label3.ForeColor = System.Drawing.Color.Blue
		self._label3.Location = System.Drawing.Point(19, 12)
		self._label3.Name = "label3"
		self._label3.Size = System.Drawing.Size(142, 23)
		self._label3.TabIndex = 4
		self._label3.Text = "RefLevel"
		# 
		# comboBox3
		# 
		self._comboBox3.AllowDrop = True
		self._comboBox3.Cursor = System.Windows.Forms.Cursors.AppStarting
		self._comboBox3.FormattingEnabled = True
		self._comboBox3.Location = System.Drawing.Point(180, 12)
		self._comboBox3.Name = "comboBox3"
		self._comboBox3.Size = System.Drawing.Size(263, 23)
		self._comboBox3.TabIndex = 3
		self._comboBox3.SelectedIndexChanged += self.ComboBox3_SelectedIndexChanged
		self._comboBox3.Items.AddRange(System.Array[System.Object](levelsNameCollector))			
		# 
		# groupBox4
		# 
		self._groupBox4.Controls.Add(self._textBox1)
		self._groupBox4.Controls.Add(self._label4)
		self._groupBox4.Location = System.Drawing.Point(12, 318)
		self._groupBox4.Name = "groupBox4"
		self._groupBox4.Size = System.Drawing.Size(449, 47)
		self._groupBox4.TabIndex = 7
		self._groupBox4.TabStop = False
		# 
		# label4
		# 
		self._label4.BackColor = System.Drawing.SystemColors.Info
		self._label4.BorderStyle = System.Windows.Forms.BorderStyle.Fixed3D
		self._label4.Font = System.Drawing.Font("MS UI Gothic", 9, System.Drawing.FontStyle.Bold, System.Drawing.GraphicsUnit.Point, 128)
		self._label4.ForeColor = System.Drawing.Color.Blue
		self._label4.Location = System.Drawing.Point(19, 12)
		self._label4.Name = "label4"
		self._label4.Size = System.Drawing.Size(142, 23)
		self._label4.TabIndex = 4
		self._label4.Text = "Diameter"
		# 
		# textBox1
		# 
		self._textBox1.Location = System.Drawing.Point(180, 12)
		self._textBox1.Name = "textBox1"
		self._textBox1.Size = System.Drawing.Size(263, 22)
		self._textBox1.TabIndex = 5
		# 
		# button3
		# 
		self._button3.BackColor = System.Drawing.SystemColors.ScrollBar
		self._button3.Cursor = System.Windows.Forms.Cursors.WaitCursor
		self._button3.Font = System.Drawing.Font("MS UI Gothic", 10, System.Drawing.FontStyle.Bold, System.Drawing.GraphicsUnit.Point, 128, True)
		self._button3.ForeColor = System.Drawing.Color.Red
		self._button3.Location = System.Drawing.Point(317, 395)
		self._button3.Name = "button3"
		self._button3.Size = System.Drawing.Size(49, 30)
		self._button3.TabIndex = 8
		self._button3.Text = "OK"
		self._button3.UseVisualStyleBackColor = False
		# 
		# button4
		# 
		self._button4.BackColor = System.Drawing.SystemColors.ScrollBar
		self._button4.Cursor = System.Windows.Forms.Cursors.WaitCursor
		self._button4.Font = System.Drawing.Font("MS UI Gothic", 10, System.Drawing.FontStyle.Bold, System.Drawing.GraphicsUnit.Point, 128, True)
		self._button4.ForeColor = System.Drawing.Color.Red
		self._button4.Location = System.Drawing.Point(372, 395)
		self._button4.Name = "button4"
		self._button4.Size = System.Drawing.Size(89, 30)
		self._button4.TabIndex = 8
		self._button4.Text = "CANCLE"
		self._button4.UseVisualStyleBackColor = False
		# 
		# label5
		# 
		self._label5.Location = System.Drawing.Point(1, 434)
		self._label5.Name = "label5"
		self._label5.Size = System.Drawing.Size(53, 19)
		self._label5.TabIndex = 9
		self._label5.Text = "@FVC"
		# 
		# MainForm
		# 
		self.ClientSize = System.Drawing.Size(482, 453)
		self.Controls.Add(self._label5)
		self.Controls.Add(self._button4)
		self.Controls.Add(self._button3)
		self.Controls.Add(self._groupBox4)
		self.Controls.Add(self._groupBox3)
		self.Controls.Add(self._groupBox2)
		self.Controls.Add(self._button2)
		self.Controls.Add(self._button1)
		self.Controls.Add(self._groupBox1)
		self.Name = "MainForm"
		self.Text = "PipeCreate"
		self._groupBox1.ResumeLayout(False)
		self._groupBox2.ResumeLayout(False)
		self._groupBox3.ResumeLayout(False)
		self._groupBox4.ResumeLayout(False)
		self._groupBox4.PerformLayout()
		self.ResumeLayout(False)


	def Label2Click(self, sender, e):
		pass


	def ComboBox1_SelectedIndexChanged(self, sender, e):
		TransactionManager.Instance.EnsureInTransaction(doc)



		TransactionManager.Instance.TransactionTaskDone()
		pass
	
	def ComboBox2_SelectedIndexChanged(self, sender, e):
		TransactionManager.Instance.EnsureInTransaction(doc)



		TransactionManager.Instance.TransactionTaskDone()
		pass	

	def ComboBox3_SelectedIndexChanged(self, sender, e):
		TransactionManager.Instance.EnsureInTransaction(doc)



		TransactionManager.Instance.TransactionTaskDone()
		pass


f = MainForm()
Application.Run(f)
# ----------------------------------------
boolean_4 = BoolSelector(true)
number = DoubleInput(500)
code_block = CodeBlock { "通気"; }
python_script_4 = Python(IN[0]=boolean_4, IN[1]=number, IN[2]=code_block)  # IronPython2
# ---------- python_script_4.python (64 lines) ----------
"""Copyright by: vudinhduybm@gmail.com"""
import clr 
import sys 
import System   
clr.AddReference("ProtoGeometry")
from Autodesk.DesignScript.Geometry import *

clr.AddReference("RevitAPI") 
from Autodesk.Revit.DB import*
from Autodesk.Revit.DB.Structure import*

clr.AddReference("RevitAPIUI") 
from Autodesk.Revit.UI import*

clr.AddReference("System") 
from System.Collections.Generic import List

clr.AddReference("RevitNodes")
import Revit
clr.ImportExtensions(Revit.Elements)
clr.ImportExtensions(Revit.GeometryConversion)

clr.AddReference("RevitServices")
import RevitServices
from RevitServices.Persistence import DocumentManager
from RevitServices.Transactions import TransactionManager

#Current doc/app/ui
doc = DocumentManager.Instance.CurrentDBDocument
uiapp = DocumentManager.Instance.CurrentUIApplication
app = uiapp.Application
uidoc = DocumentManager.Instance.CurrentUIApplication.ActiveUIDocument
view = doc.ActiveView

diameterIN = UnwrapElement(IN[1])
inSystemName = UnwrapElement(IN[2])

categories = [BuiltInCategory.OST_PipeCurves]
categoriesFilter = []
for c in categories:
    collector = FilteredElementCollector(doc).OfCategory(c).WhereElementIsNotElementType()
    categoriesFilter.append(collector)
flat_categoriesFilter = [item for sublist in categoriesFilter for item in sublist]
IDS = List[ElementId]()
for i in flat_categoriesFilter:
	IDS.Add(i.Id)

desPipes = []

paramFilter1 = ParameterValueProvider(ElementId(BuiltInParameter.RBS_PIPING_SYSTEM_TYPE_PARAM))
reason1 = FilterStringEquals()
fRule = FilterStringRule(paramFilter1,reason1, inSystemName)
filter1 = ElementParameterFilter(fRule)

i_Check = IN[1]/304.8
paramFilter2 = ParameterValueProvider(ElementId(BuiltInParameter.RBS_PIPE_DIAMETER_PARAM))
reason2 = FilterNumericEquals()
reason3 = FilterNumericGreaterOrEqual()
fRule2 = FilterDoubleRule(paramFilter2,reason2,i_Check,0.02)
filter2 = ElementParameterFilter(fRule2)
combineFilter = LogicalAndFilter(filter1 , filter2)
desPipes = FilteredElementCollector(doc, IDS).WherePasses(filter2).WhereElementIsNotElementType().ToElements()

OUT = desPipes
# ----------------------------------------
python_script_5 = Python()  # IronPython2; unwired: IN[0]
# ---------- python_script_5.python (46 lines) ----------
"""Copyright by: vudinhduybm@gmail.com"""
import clr 
import sys 
import System   
clr.AddReference("ProtoGeometry")
from Autodesk.DesignScript.Geometry import *

clr.AddReference("RevitAPI") 
from Autodesk.Revit.DB import*
from Autodesk.Revit.DB.Structure import*

clr.AddReference("RevitAPIUI") 
from Autodesk.Revit.UI import*

clr.AddReference("System") 
from System.Collections.Generic import List

clr.AddReference("RevitNodes")
import Revit
clr.ImportExtensions(Revit.Elements)
clr.ImportExtensions(Revit.GeometryConversion)

clr.AddReference("RevitServices")
import RevitServices
from RevitServices.Persistence import DocumentManager
from RevitServices.Transactions import TransactionManager

#Current doc/app/ui
doc = DocumentManager.Instance.CurrentDBDocument
uiapp = DocumentManager.Instance.CurrentUIApplication
app = uiapp.Application
uidoc = DocumentManager.Instance.CurrentUIApplication.ActiveUIDocument
view = doc.ActiveView

#Preparing input from dynamo to revit
element = UnwrapElement(IN[0])

#Do some action in a Transaction
TransactionManager.Instance.EnsureInTransaction(doc)
"""Now, You Can Code """



TransactionManager.Instance.TransactionTaskDone()

OUT = element
# ----------------------------------------
boolean_5 = BoolSelector(true)  # frozen
file_path_3 = Filename("..\Test.py")
python_script_6 = Python(IN[0]=boolean_5, IN[1]=file_path_3)  # IronPython2
# ---------- python_script_6.python (5 lines) ----------
re  = open(r"C:\Users\95053\Desktop\Python\RevitAPI-master\RevitAPI\Test.py", "r")

interpret = re.read()

OUT =  interpret
# ----------------------------------------
python_script_from_string_3 = PythonStringNode(script=python_script_6)  # IronPython2; unwired: IN[0]
code_block_2 = CodeBlock { [data,waitfor][0]; }  # unwired: data, waitfor
boolean_6 = BoolSelector(false)  # frozen
boolean_7 = BoolSelector(false)
python_script_7 = Python(IN[0]=boolean_6, IN[1]=boolean_7)  # IronPython2
# ---------- python_script_7.python (48 lines) ----------
"""Copyright by: vudinhduybm@gmail.com"""
import clr 
from System.Collections.Generic import *

clr.AddReference("ProtoGeometry")
from Autodesk.DesignScript.Geometry import *

clr.AddReference('RevitAPI')
from Autodesk.Revit.DB.Events import*

clr.AddReference('RevitAPIUI')
from Autodesk.Revit.UI import TaskDialog

clr.AddReference("RevitServices")
import RevitServices
from RevitServices.Persistence import DocumentManager

doc = DocumentManager.Instance.CurrentDBDocument
view = doc.ActiveView
uidoc = DocumentManager.Instance.CurrentUIApplication.ActiveUIDocument

inValue = UnwrapElement(IN[1])
x = True
dypoint = []
rpointM = []
rpointI = []
counter=0
# msg = 'Pick Points on current Workplane in order, hit ESC when finished.'

# TaskDialog.Show("Duynamo", msg)

while x == True and inValue == True:
	msg = 'Pick Points on current Workplane in order, hit ESC when finished.'

	TaskDialog.Show("Duynamo", msg)
	try:
		pt=uidoc.Selection.PickPoint()
		rpM=Point.ByCoordinates(pt.X*304.8,pt.Y*304.8,pt.Z*304.8)# don vi do mac dinh trong revitAPI la Inch, 1in=304.8mm
		rpI=Point.ByCoordinates(pt.X,pt.Y,pt.Z)
		counter=+1
		dypoint.append(pt)
		rpointM.append(rpM)
		rpointI.append(rpI)
	except:
		x=False
	

OUT=(dypoint,rpointM,rpointI)
# ----------------------------------------
code_block_3 = CodeBlock { 102; }
boolean_8 = BoolSelector(true)  # frozen
boolean_9 = BoolSelector(true)
python_script_8 = Python(IN[0]=boolean_8, IN[1]=boolean_9)  # IronPython2
# ---------- python_script_8.python (48 lines) ----------
"""Copyright by: vudinhduybm@gmail.com"""
import clr 
from System.Collections.Generic import *

clr.AddReference("ProtoGeometry")
from Autodesk.DesignScript.Geometry import *

clr.AddReference('RevitAPI')
from Autodesk.Revit.DB.Events import*

clr.AddReference('RevitAPIUI')
from Autodesk.Revit.UI import TaskDialog

clr.AddReference("RevitServices")
import RevitServices
from RevitServices.Persistence import DocumentManager

doc = DocumentManager.Instance.CurrentDBDocument
view = doc.ActiveView
uidoc = DocumentManager.Instance.CurrentUIApplication.ActiveUIDocument

inValue = UnwrapElement(IN[1])
x = True
dypoint = []
rpointM = []
rpointI = []
counter=0
msg = 'Pick Points on current Workplane in order, hit ESC when finished.'

TaskDialog.Show("Duynamo", msg)

while x == True and inValue == True :
	# msg = 'Pick Points on current Workplane in order, hit ESC when finished.'

	# TaskDialog.Show("Duynamo", msg)
	try:
		pt=uidoc.Selection.PickPoint()
		rpM=Point.ByCoordinates(pt.X*304.8,pt.Y*304.8,pt.Z*304.8)# don vi do mac dinh trong revitAPI la Inch, 1in=304.8mm
		rpI=Point.ByCoordinates(pt.X,pt.Y,pt.Z)
		counter += 1
		dypoint.append(pt)
		rpointM.append(rpM)
		rpointI.append(rpI)
	except:
		x=False
	

OUT=(dypoint,rpointM,rpointI)
# ----------------------------------------
boolean_10 = BoolSelector(true)  # frozen
pickPoints = Custom[pickPoints](Reset=boolean_10)  # package Duynamo; from Duynamo. pick Point in current Workplane and retrive Revit Points in Millimeter unit
code_block_4 = CodeBlock(a=pickPoints.DynamoXYZ) { a; }
boolean_11 = BoolSelector(false)
code_block_5 = CodeBlock(data=boolean_11, waitfor=pickPoints.DynamoXYZ) { [data, waitfor][0]; }
python_script_9 = Python(IN[0]=code_block_5)  # IronPython2; unwired: IN[1]
# ---------- python_script_9.python (79 lines) ----------
import clr
import sys 
import System   


clr.AddReference("ProtoGeometry")
from Autodesk.DesignScript.Geometry import *

clr.AddReference("RevitAPI") 
import Autodesk
from Autodesk.Revit.DB import* 
from Autodesk.Revit.DB.Structure import*


clr.AddReference("RevitAPIUI") 
from Autodesk.Revit.UI import*

clr.AddReference("System") 
from System.Collections.Generic import List

clr.AddReference("RevitNodes")
import Revit
clr.ImportExtensions(Revit.Elements)
clr.ImportExtensions(Revit.GeometryConversion)

clr.AddReference("RevitServices")
import RevitServices
from RevitServices.Persistence import DocumentManager
from RevitServices.Transactions import TransactionManager

clr.AddReference("System.Windows.Forms")
clr.AddReference("System.Drawing")
clr.AddReference("System.Windows.Forms.DataVisualization")

import System.Windows.Forms 
from System.Windows.Forms import *
import System.Drawing
from System.Drawing import *

doc = DocumentManager.Instance.CurrentDBDocument
uiapp = DocumentManager.Instance.CurrentUIApplication
app = uiapp.Application
uidoc = DocumentManager.Instance.CurrentUIApplication.ActiveUIDocument
view = doc.ActiveView


TransactionManager.Instance.EnsureInTransaction(doc)

activeView = doc.ActiveView
iRefPlane = Plane.CreateByNormalAndOrigin(activeView.ViewDirection, activeView.Origin)
sketchPlane = SketchPlane.Create(doc, iRefPlane)
doc.ActiveView.SketchPlane = sketchPlane
condition = True
pointsZ = []
n = 0

lst = []

msg = "Pick Points on Current Section plane, hit ESC when finished."
TaskDialog.Show("^---Ai An Banh Mi Khong??---^", msg)

while condition:
	try:
			# logger('Line383:', n)
			
		pt=uidoc.Selection.PickPoint()
		n += 1
		pointsZ.append(pt)
	
	except :
		condition = False
doc.Delete(sketchPlane.Id)	
for i in pointsZ:
	rpM = Autodesk.DesignScript.Geometry.Point.ByCoordinates(i.X*304.8,i.Y*304.8,i.Z*304.8)
	lst.Add(rpM)
TransactionManager.Instance.TransactionTaskDone()			


OUT = lst
# ----------------------------------------
code_block_6 = CodeBlock(b=python_script_9) { b; }
python_script_10 = Python(IN[0]=code_block_4, IN[1]=code_block_6)  # IronPython2
# ---------- python_script_10.python (56 lines) ----------
import clr
import sys 
import System   


clr.AddReference("ProtoGeometry")
from Autodesk.DesignScript.Geometry import *

clr.AddReference("RevitAPI") 
import Autodesk
from Autodesk.Revit.DB import* 
from Autodesk.Revit.DB.Structure import*


clr.AddReference("RevitAPIUI") 
from Autodesk.Revit.UI import*

clr.AddReference("System") 
from System.Collections.Generic import List

clr.AddReference("RevitNodes")
import Revit
clr.ImportExtensions(Revit.Elements)
clr.ImportExtensions(Revit.GeometryConversion)

clr.AddReference("RevitServices")
import RevitServices
from RevitServices.Persistence import DocumentManager
from RevitServices.Transactions import TransactionManager

clr.AddReference("System.Windows.Forms")
clr.AddReference("System.Drawing")
clr.AddReference("System.Windows.Forms.DataVisualization")

import System.Windows.Forms 
from System.Windows.Forms import *
import System.Drawing
from System.Drawing import *

doc = DocumentManager.Instance.CurrentDBDocument
uiapp = DocumentManager.Instance.CurrentUIApplication
app = uiapp.Application
uidoc = DocumentManager.Instance.CurrentUIApplication.ActiveUIDocument
view = doc.ActiveView

#Preparing input from dynamo to revit
lst1 = UnwrapElement(IN[0])
lst2 = UnwrapElement(IN[1])

desPointsList = []

for i,j in zip(lst1, lst2):
	desPoint = Autodesk.DesignScript.Geometry.Point.ByCoordinates(i.X*304.8, i.Y*304.8, j.Z*304.8)
	desPointsList.append(desPoint)

OUT = desPointsList
# ----------------------------------------
boolean_12 = BoolSelector(true)  # frozen
python_script_11 = Python(IN[0]=boolean_12)  # IronPython2; unwired: IN[1]
# ---------- python_script_11.python (680 lines) ----------
import clr
import sys 
import System   

clr.AddReference("ProtoGeometry")
from Autodesk.DesignScript.Geometry import *

clr.AddReference("RevitAPI") 
import Autodesk
from Autodesk.Revit.DB import* 
from Autodesk.Revit.DB.Structure import*

clr.AddReference("RevitAPIUI") 
from Autodesk.Revit.UI import*

clr.AddReference("System") 
from System.Collections.Generic import List

clr.AddReference("RevitNodes")
import Revit
clr.ImportExtensions(Revit.Elements)
clr.ImportExtensions(Revit.GeometryConversion)

clr.AddReference("RevitServices")
import RevitServices
from RevitServices.Persistence import DocumentManager
from RevitServices.Transactions import TransactionManager

clr.AddReference("System.Windows.Forms")
clr.AddReference("System.Drawing")
clr.AddReference("System.Windows.Forms.DataVisualization")

import System.Windows.Forms 
from System.Windows.Forms import *
import System.Drawing
from System.Drawing import *

doc = DocumentManager.Instance.CurrentDBDocument
uiapp = DocumentManager.Instance.CurrentUIApplication
app = uiapp.Application
uidoc = DocumentManager.Instance.CurrentUIApplication.ActiveUIDocument
view = doc.ActiveView

"""________________________________________________________________________________________"""
def getAllPipingSystemsName(doc):
	collector = FilteredElementCollector(doc).OfCategory(BuiltInCategory.OST_PipingSystem)
	pipingSystems = collector.ToElements()
	pipingSystemsName = []
	for system in pipingSystems:
		systemName = system.get_Parameter(BuiltInParameter.SYMBOL_NAME_PARAM).AsString()
		pipingSystemsName.append(systemName)
	return pipingSystemsName
lst = getAllPipingSystemsName(doc)
pipingSystemsCollector = [item for item in lst if item is not None]

def getAllPipingSystems(doc):
	collector = FilteredElementCollector(doc).OfCategory(BuiltInCategory.OST_PipingSystem)
	pipingSystems = collector.ToElements()
	return pipingSystems
"""_______________________________________________________________________________________"""
def getAllPipeTypesName(doc):
	collector1 = FilteredElementCollector(doc).OfCategory(BuiltInCategory.OST_PipeCurves)
	pipeTypes = collector1.ToElements()
	pipeTypesName = []
	for pipeType in pipeTypes:
		pipeTypeName = pipeType.get_Parameter(BuiltInParameter.SYMBOL_NAME_PARAM).AsString()
		pipeTypesName.append(pipeTypeName)
	return pipeTypesName
lst1 = getAllPipeTypesName(doc)
pipeTypesCollector = [item for item in lst1 if item is not None]
"""_______________________________________________________________________________________"""
def createModelText(doc, points, text_size, start_value=1):
	modelTextsList = []
	if not isinstance(points, list) or len(points) == 0:
		raise ValueError("Invalid input for points.")
	for i, point in enumerate(points):
		number = start_value + i
		textValue = "Point " + str(number)
		textSize = 15
		modelTextsList.append(i for i in createModelText(doc, point, textValue, textSize))
	return modelTextsList
	
"""_______________________________________________________________________________________"""
def getAllPipeTypes(doc):
	collector1 = FilteredElementCollector(doc).OfCategory(BuiltInCategory.OST_PipeCurves)
	pipeTypes = collector1.ToElements()
	return pipeTypes
"""________________________________________________________________________________________"""
def create_model_text(doc, text, model_text_type, sketch_plane, position, horizontal_align, depth):
    # Ensure valid input
    if not doc or not model_text_type or not sketch_plane or not position:
        raise ValueError("Invalid input parameters.")
    # Start a transaction
    transaction = Autodesk.Revit.DB.Transaction(doc, "Create Model Text")
    transaction.Start()
    try:
        # Create Model Text
        model_text = ModelText.Create(doc, sketch_plane.Id, position, text, model_text_type.Id, depth, horizontal_align)

        # Commit the transaction
        transaction.Commit()
    except Exception as ex:
        # Handle exceptions
        TaskDialog.Show("Error", "Failed to create model text: " + str(ex))
        transaction.RollBack()
"""______________________________________________________________________________________"""

levelsCollector = FilteredElementCollector(doc).OfClass(Level).ToElements()
"""________________________________________________________________________________________"""

def logger(title, content):
	import datetime
	date = datetime.datetime.now()
	f = open(r"C:\Users\95053\Desktop\Python\RevitAPI-master\RevitAPI\python.log", 'a')
	# C:\Users\95053\Desktop\Python\RevitAPI-master\RevitAPI\PipeCreate.py
	f.write(str(date) + '\n' + title + '\n' + str(content) + '\n')
	f.close()

class MainForm(Form):
	def __init__(self):
		self.InitializeComponent()
	
	def InitializeComponent(self):
		self._groupBox1 = System.Windows.Forms.GroupBox()
		self._btt_getXY = System.Windows.Forms.Button()
		self._btt_getZ = System.Windows.Forms.Button()
		self._cbb_PipingSystemType = System.Windows.Forms.ComboBox()
		self._label1 = System.Windows.Forms.Label()
		self._groupBox2 = System.Windows.Forms.GroupBox()
		self._label2 = System.Windows.Forms.Label()
		self._cbb_PipeType = System.Windows.Forms.ComboBox()
		self._groupBox3 = System.Windows.Forms.GroupBox()
		self._label3 = System.Windows.Forms.Label()
		self._cbb_RefLevel = System.Windows.Forms.ComboBox()
		self._groupBox4 = System.Windows.Forms.GroupBox()
		self._label4 = System.Windows.Forms.Label()
		self._txb_Diameter = System.Windows.Forms.TextBox()
		self._btt_OK = System.Windows.Forms.Button()
		self._btt_CANCLE = System.Windows.Forms.Button()
		self._label5 = System.Windows.Forms.Label()
		self._groupBox5 = System.Windows.Forms.GroupBox()
		self._clb_XYValue = System.Windows.Forms.CheckedListBox()
		self._clb_ZValue = System.Windows.Forms.CheckedListBox()
		self._cbb_AllXY = System.Windows.Forms.CheckBox()
		self._cbb_AllZ = System.Windows.Forms.CheckBox()
		self._total_XYValue = System.Windows.Forms.TextBox()
		self._total_ZValue = System.Windows.Forms.TextBox()
		self._label6 = System.Windows.Forms.Label()
		self._label7 = System.Windows.Forms.Label()
		self._groupBox1.SuspendLayout()
		self._groupBox2.SuspendLayout()
		self._groupBox3.SuspendLayout()
		self._groupBox4.SuspendLayout()
		self._groupBox5.SuspendLayout()
		self.SuspendLayout()
		# 
		# groupBox1
		# 
		self._groupBox1.Controls.Add(self._label1)
		self._groupBox1.Controls.Add(self._cbb_PipingSystemType)
		self._groupBox1.Location = System.Drawing.Point(12, 234)
		self._groupBox1.Name = "groupBox1"
		self._groupBox1.Size = System.Drawing.Size(449, 47)
		self._groupBox1.TabIndex = 0
		self._groupBox1.TabStop = False
		# 
		# btt_getXY
		# 
		self._btt_getXY.BackColor = System.Drawing.SystemColors.Info
		self._btt_getXY.Font = System.Drawing.Font("MS UI Gothic", 10, System.Drawing.FontStyle.Bold, System.Drawing.GraphicsUnit.Point, 128, True)
		self._btt_getXY.ForeColor = System.Drawing.Color.Red
		self._btt_getXY.Location = System.Drawing.Point(55, 8)
		self._btt_getXY.Name = "btt_getXY"
		self._btt_getXY.Size = System.Drawing.Size(140, 30)
		self._btt_getXY.TabIndex = 1
		self._btt_getXY.Text = "get X,Y value"
		self._btt_getXY.UseVisualStyleBackColor = False
		self._btt_getXY.Click += self.Btt_getXYClick
		# 
		# btt_getZ
		# 
		self._btt_getZ.BackColor = System.Drawing.SystemColors.Info
		self._btt_getZ.Cursor = System.Windows.Forms.Cursors.AppStarting
		self._btt_getZ.Font = System.Drawing.Font("MS UI Gothic", 10, System.Drawing.FontStyle.Bold, System.Drawing.GraphicsUnit.Point, 128, True)
		self._btt_getZ.ForeColor = System.Drawing.Color.Red
		self._btt_getZ.Location = System.Drawing.Point(283, 8)
		self._btt_getZ.Name = "btt_getZ"
		self._btt_getZ.Size = System.Drawing.Size(140, 30)
		self._btt_getZ.TabIndex = 2
		self._btt_getZ.Text = "get Z value"
		self._btt_getZ.UseVisualStyleBackColor = False
		self._btt_getZ.Click += self.Btt_getZClick
		# 
		# cbb_PipingSystemType
		# 
		self._cbb_PipingSystemType.DisplayMember = "Name"		
		self._cbb_PipingSystemType.AllowDrop = True
		self._cbb_PipingSystemType.Cursor = System.Windows.Forms.Cursors.AppStarting
		self._cbb_PipingSystemType.FormattingEnabled = True
		self._cbb_PipingSystemType.Location = System.Drawing.Point(180, 12)
		self._cbb_PipingSystemType.Name = "cbb_PipingSystemType"
		self._cbb_PipingSystemType.Size = System.Drawing.Size(263, 23)
		self._cbb_PipingSystemType.TabIndex = 3
		self._cbb_PipingSystemType.SelectedIndexChanged += self.Cbb_PipingSystemTypeSelectedIndexChanged
		self._cbb_PipingSystemType.Items.AddRange(System.Array[System.Object](pipingSystemsCollector)) 
		self._cbb_PipingSystemType.SelectedIndex = 0		
		# 
		# label1
		# 
		self._label1.BackColor = System.Drawing.SystemColors.Info
		self._label1.BorderStyle = System.Windows.Forms.BorderStyle.Fixed3D
		self._label1.Font = System.Drawing.Font("MS UI Gothic", 9, System.Drawing.FontStyle.Bold, System.Drawing.GraphicsUnit.Point, 128)
		self._label1.ForeColor = System.Drawing.Color.Blue
		self._label1.Location = System.Drawing.Point(6, 14)
		self._label1.Name = "label1"
		self._label1.Size = System.Drawing.Size(142, 23)
		self._label1.TabIndex = 4
		self._label1.Text = "PipingSystemType"
		# 
		# groupBox2
		# 
		self._groupBox2.Controls.Add(self._label2)
		self._groupBox2.Controls.Add(self._cbb_PipeType)
		self._groupBox2.Location = System.Drawing.Point(12, 287)
		self._groupBox2.Name = "groupBox2"
		self._groupBox2.Size = System.Drawing.Size(449, 47)
		self._groupBox2.TabIndex = 5
		self._groupBox2.TabStop = False
		# 
		# label2
		# 
		self._label2.BackColor = System.Drawing.SystemColors.Info
		self._label2.BorderStyle = System.Windows.Forms.BorderStyle.Fixed3D
		self._label2.Font = System.Drawing.Font("MS UI Gothic", 9, System.Drawing.FontStyle.Bold, System.Drawing.GraphicsUnit.Point, 128)
		self._label2.ForeColor = System.Drawing.Color.Blue
		self._label2.Location = System.Drawing.Point(6, 12)
		self._label2.Name = "label2"
		self._label2.Size = System.Drawing.Size(142, 23)
		self._label2.TabIndex = 4
		self._label2.Text = "PipeType"
		# 
		# cbb_PipeType
		# 
		self._cbb_PipeType.DisplayMember = "Name"		
		self._cbb_PipeType.AllowDrop = True
		self._cbb_PipeType.Cursor = System.Windows.Forms.Cursors.AppStarting
		self._cbb_PipeType.FormattingEnabled = True
		self._cbb_PipeType.Location = System.Drawing.Point(180, 12)
		self._cbb_PipeType.Name = "cbb_PipeType"
		self._cbb_PipeType.Size = System.Drawing.Size(263, 23)
		self._cbb_PipeType.TabIndex = 3
		self._cbb_PipeType.SelectedIndexChanged += self.Cbb_PipeTypeSelectedIndexChanged
		self._cbb_PipeType.Items.AddRange(System.Array[System.Object](pipeTypesCollector))
		self._cbb_PipeType.SelectedIndex = 0		
		# 
		# groupBox3
		# 
		self._groupBox3.Controls.Add(self._label3)
		self._groupBox3.Controls.Add(self._cbb_RefLevel)
		self._groupBox3.Location = System.Drawing.Point(12, 340)
		self._groupBox3.Name = "groupBox3"
		self._groupBox3.Size = System.Drawing.Size(449, 47)
		self._groupBox3.TabIndex = 6
		self._groupBox3.TabStop = False
		# 
		# label3
		# 
		self._label3.BackColor = System.Drawing.SystemColors.Info
		self._label3.BorderStyle = System.Windows.Forms.BorderStyle.Fixed3D
		self._label3.Font = System.Drawing.Font("MS UI Gothic", 9, System.Drawing.FontStyle.Bold, System.Drawing.GraphicsUnit.Point, 128)
		self._label3.ForeColor = System.Drawing.Color.Blue
		self._label3.Location = System.Drawing.Point(6, 12)
		self._label3.Name = "label3"
		self._label3.Size = System.Drawing.Size(142, 23)
		self._label3.TabIndex = 4
		self._label3.Text = "RefLevel"
		# 
		# cbb_RefLevel
		# 
		self._cbb_RefLevel.DisplayMember = "Name"		
		self._cbb_RefLevel.AllowDrop = True
		self._cbb_RefLevel.Cursor = System.Windows.Forms.Cursors.AppStarting
		self._cbb_RefLevel.FormattingEnabled = True
		self._cbb_RefLevel.Location = System.Drawing.Point(180, 12)
		self._cbb_RefLevel.Name = "cbb_RefLevel"
		self._cbb_RefLevel.Size = System.Drawing.Size(263, 23)
		self._cbb_RefLevel.TabIndex = 3
		self._cbb_RefLevel.SelectedIndexChanged += self.Cbb_RefLevelSelectedIndexChanged
		self._cbb_RefLevel.Items.AddRange(System.Array[System.Object](levelsCollector))
		self._cbb_RefLevel.SelectedIndex = 0				
		# 
		# groupBox4
		# 
		self._groupBox4.Controls.Add(self._txb_Diameter)
		self._groupBox4.Controls.Add(self._label4)
		self._groupBox4.Location = System.Drawing.Point(12, 393)
		self._groupBox4.Name = "groupBox4"
		self._groupBox4.Size = System.Drawing.Size(449, 47)
		self._groupBox4.TabIndex = 7
		self._groupBox4.TabStop = False
		# 
		# label4
		# 
		self._label4.BackColor = System.Drawing.SystemColors.Info
		self._label4.BorderStyle = System.Windows.Forms.BorderStyle.Fixed3D
		self._label4.Font = System.Drawing.Font("MS UI Gothic", 9, System.Drawing.FontStyle.Bold, System.Drawing.GraphicsUnit.Point, 128)
		self._label4.ForeColor = System.Drawing.Color.Blue
		self._label4.Location = System.Drawing.Point(6, 12)
		self._label4.Name = "label4"
		self._label4.Size = System.Drawing.Size(142, 23)
		self._label4.TabIndex = 4
		self._label4.Text = "Diameter"
		# 
		# txb_Diameter
		# 
		self._txb_Diameter.Location = System.Drawing.Point(180, 12)
		self._txb_Diameter.Name = "txb_Diameter"
		self._txb_Diameter.Size = System.Drawing.Size(263, 22)
		self._txb_Diameter.TabIndex = 5
		self._txb_Diameter.TextChanged += self.Txb_DiameterTextChanged
		# 
		# btt_OK
		# 
		self._btt_OK.BackColor = System.Drawing.SystemColors.ScrollBar
		self._btt_OK.Cursor = System.Windows.Forms.Cursors.WaitCursor
		self._btt_OK.Font = System.Drawing.Font("MS UI Gothic", 10, System.Drawing.FontStyle.Bold, System.Drawing.GraphicsUnit.Point, 128, True)
		self._btt_OK.ForeColor = System.Drawing.Color.Red
		self._btt_OK.Location = System.Drawing.Point(317, 464)
		self._btt_OK.Name = "btt_OK"
		self._btt_OK.Size = System.Drawing.Size(49, 30)
		self._btt_OK.TabIndex = 8
		self._btt_OK.Text = "OK"
		self._btt_OK.UseVisualStyleBackColor = False
		self._btt_OK.Click += self.Btt_OKClick
		# 
		# btt_CANCLE
		# 
		self._btt_CANCLE.BackColor = System.Drawing.SystemColors.ScrollBar
		self._btt_CANCLE.Cursor = System.Windows.Forms.Cursors.WaitCursor
		self._btt_CANCLE.Font = System.Drawing.Font("MS UI Gothic", 10, System.Drawing.FontStyle.Bold, System.Drawing.GraphicsUnit.Point, 128, True)
		self._btt_CANCLE.ForeColor = System.Drawing.Color.Red
		self._btt_CANCLE.Location = System.Drawing.Point(372, 464)
		self._btt_CANCLE.Name = "btt_CANCLE"
		self._btt_CANCLE.Size = System.Drawing.Size(89, 30)
		self._btt_CANCLE.TabIndex = 8
		self._btt_CANCLE.Text = "CANCLE"
		self._btt_CANCLE.UseVisualStyleBackColor = False
		self._btt_CANCLE.Click += self.Btt_CANCLEClick
		# 
		# label5
		# 
		self._label5.Location = System.Drawing.Point(15, 480)
		self._label5.Name = "label5"
		self._label5.Size = System.Drawing.Size(53, 19)
		self._label5.TabIndex = 9
		self._label5.Text = "@FVC"
		# 
		# groupBox5
		# 
		self._groupBox5.Controls.Add(self._label7)
		self._groupBox5.Controls.Add(self._label6)
		self._groupBox5.Controls.Add(self._total_ZValue)
		self._groupBox5.Controls.Add(self._total_XYValue)
		self._groupBox5.Controls.Add(self._cbb_AllZ)
		self._groupBox5.Controls.Add(self._cbb_AllXY)
		self._groupBox5.Controls.Add(self._clb_ZValue)
		self._groupBox5.Controls.Add(self._clb_XYValue)
		self._groupBox5.Location = System.Drawing.Point(13, 44)
		self._groupBox5.Name = "groupBox5"
		self._groupBox5.Size = System.Drawing.Size(457, 184)
		self._groupBox5.TabIndex = 10
		self._groupBox5.TabStop = False
		# self._groupBox5.Enter += self.GroupBox5Enter
		# 
		# clb_XYValue
		# 
		self._clb_XYValue.AllowDrop = True
		self._clb_XYValue.CheckOnClick = True
		self._clb_XYValue.Font = System.Drawing.Font("Meiryo UI", 7, System.Drawing.FontStyle.Regular, System.Drawing.GraphicsUnit.Point, 128)
		self._clb_XYValue.FormattingEnabled = True
		self._clb_XYValue.HorizontalScrollbar = True
		self._clb_XYValue.Location = System.Drawing.Point(0, 40)
		self._clb_XYValue.Name = "clb_XYValue"
		self._clb_XYValue.Size = System.Drawing.Size(213, 123)
		self._clb_XYValue.TabIndex = 0
		self._clb_XYValue.SelectedIndexChanged += self.Clb_XYValueSelectedIndexChanged
		# 
		# clb_ZValue
		# 
		self._clb_ZValue.AllowDrop = True
		self._clb_ZValue.CheckOnClick = True
		self._clb_ZValue.Font = System.Drawing.Font("Meiryo UI", 7, System.Drawing.FontStyle.Regular, System.Drawing.GraphicsUnit.Point, 128)
		self._clb_ZValue.FormattingEnabled = True
		self._clb_ZValue.HorizontalScrollbar = True
		self._clb_ZValue.Location = System.Drawing.Point(232, 40)
		self._clb_ZValue.Name = "clb_ZValue"
		self._clb_ZValue.Size = System.Drawing.Size(216, 123)
		self._clb_ZValue.TabIndex = 1
		self._clb_ZValue.SelectedIndexChanged += self.Clb_ZValueSelectedIndexChanged
		# 
		# cbb_AllXY
		# 
		self._cbb_AllXY.Font = System.Drawing.Font("Meiryo UI", 7, System.Drawing.FontStyle.Regular, System.Drawing.GraphicsUnit.Point, 128)
		self._cbb_AllXY.Location = System.Drawing.Point(2, 12)
		self._cbb_AllXY.Name = "cbb_AllXY"
		self._cbb_AllXY.Size = System.Drawing.Size(114, 24)
		self._cbb_AllXY.TabIndex = 2
		self._cbb_AllXY.Text = "All/None"
		self._cbb_AllXY.UseVisualStyleBackColor = True
		self._cbb_AllXY.CheckedChanged += self.Cb_AllXYCheckedChanged
		# 
		# cbb_AllZ
		# 
		self._cbb_AllZ.Font = System.Drawing.Font("Meiryo UI", 7, System.Drawing.FontStyle.Regular, System.Drawing.GraphicsUnit.Point, 128)
		self._cbb_AllZ.Location = System.Drawing.Point(235, 13)
		self._cbb_AllZ.Name = "cbb_AllZ"
		self._cbb_AllZ.Size = System.Drawing.Size(103, 24)
		self._cbb_AllZ.TabIndex = 2
		self._cbb_AllZ.Text = "All/None"
		self._cbb_AllZ.UseVisualStyleBackColor = True
		self._cbb_AllZ.CheckedChanged += self.Cbb_AllZCheckedChanged
		# 
		# total_XYValue
		# 
		self._total_XYValue.Location = System.Drawing.Point(179, 13)
		self._total_XYValue.Name = "total_XYValue"
		self._total_XYValue.Size = System.Drawing.Size(34, 22)
		self._total_XYValue.TabIndex = 3
		self._total_XYValue.TextChanged += self.Total_XYValueTextChanged
		# 
		# total_ZValue
		# 
		self._total_ZValue.Location = System.Drawing.Point(408, 13)
		self._total_ZValue.Name = "total_ZValue"
		self._total_ZValue.Size = System.Drawing.Size(34, 22)
		self._total_ZValue.TabIndex = 3
		self._total_ZValue.TextChanged += self.Total_ZValueTextChanged
		# 
		# label6
		# 
		self._label6.Font = System.Drawing.Font("Meiryo UI", 7, System.Drawing.FontStyle.Regular, System.Drawing.GraphicsUnit.Point, 128)
		self._label6.Location = System.Drawing.Point(366, 16)
		self._label6.Name = "label6"
		self._label6.Size = System.Drawing.Size(38, 19)
		self._label6.TabIndex = 4
		self._label6.Text = "Total"
		# 
		# label7
		# 
		self._label7.Font = System.Drawing.Font("Meiryo UI", 7, System.Drawing.FontStyle.Regular, System.Drawing.GraphicsUnit.Point, 128)
		self._label7.Location = System.Drawing.Point(135, 16)
		self._label7.Name = "label7"
		self._label7.Size = System.Drawing.Size(38, 19)
		self._label7.TabIndex = 4
		self._label7.Text = "Total"
		# 
		# MainForm
		# 
		self.ClientSize = System.Drawing.Size(482, 501)
		self.Controls.Add(self._groupBox5)
		self.Controls.Add(self._label5)
		self.Controls.Add(self._btt_CANCLE)
		self.Controls.Add(self._btt_OK)
		self.Controls.Add(self._groupBox4)
		self.Controls.Add(self._groupBox3)
		self.Controls.Add(self._groupBox2)
		self.Controls.Add(self._btt_getZ)
		self.Controls.Add(self._btt_getXY)
		self.Controls.Add(self._groupBox1)
		self.MaximizeBox = False
		self.MinimizeBox = False
		self.Name = "MainForm"
		self.Text = "PipeCreate"
		self._groupBox1.ResumeLayout(False)
		self._groupBox2.ResumeLayout(False)
		self._groupBox3.ResumeLayout(False)
		self._groupBox4.ResumeLayout(False)
		self._groupBox4.PerformLayout()
		self._groupBox5.ResumeLayout(False)
		self._groupBox5.PerformLayout()
		self.ResumeLayout(False)

	def Btt_getXYClick(self, sender, e):
		"""the code below worked in floor pl@ne but dont know why the bug has generated LOL"""
		#________________________________________________________________________________________#
		# TransactionManager.Instance.EnsureInTransaction(doc)
		# condition = True
		# pointsXY = []
		# n = 0
		# msg = "Pick Points on Current Floor plane, hit ESC when finished."
		# TaskDialog.Show("^---Ai An Banh Mi Khong??---^", msg)

		# while condition:
		# 	try:
		# 		logger('Line383:', n)
		# 		pt=uidoc.Selection.PickPoint()
		# 		n += 1
		# 		pointsXY.append(pt)
		# 	except :
		# 		condition = False
		# for i in pointsXY:
		# 	rpM = Autodesk.DesignScript.Geometry.Point.ByCoordinates(i.X*304.8,i.Y*304.8,i.Z*304.8)
		# 	self._clb_XYValue.Items.Add(rpM)
		# TransactionManager.Instance.TransactionTaskDone()		
		#________________________________________________________________________________________#
		TransactionManager.Instance.EnsureInTransaction(doc)
		activeView = doc.ActiveView
		iRefPlane = Plane.CreateByNormalAndOrigin(activeView.ViewDirection, activeView.Origin)
		sketchPlane = SketchPlane.Create(doc, iRefPlane)
		doc.ActiveView.SketchPlane = sketchPlane
		condition = True
		pointsXY = []
		pointsXY_modelText = []
		n = 0

		msg = "Pick Points on Current Section plane, hit ESC when finished."
		TaskDialog.Show("^---Ai An Banh Mi Khong??---^", msg)

		while condition:
			try:
				# logger('Line383:', n)
				pt=uidoc.Selection.PickPoint()
				n += 1
				pointsXY.append(pt)
				
			except :
				condition = False
		doc.Delete(sketchPlane.Id)	
		for j in pointsXY:
			rpM = Autodesk.DesignScript.Geometry.Point.ByCoordinates(j.X, j.Y, j.Z)
			rpM1 = Autodesk.DesignScript.Geometry.Point.ByCoordinates(j.X*304.8, j.Y*304, j.Z*304)
			self._clb_XYValue.Items.Add(rpM)
			pointsXY_modelText.append(rpM1)
			
		# all_modelTextType = FilteredElementCollector(doc).OfCategory(BuiltInCategory.OST_ModelText).OfClass(ModelTextType).ToElements()
		# sketch_plane = sketchPlane# Obtain or create a SketchPlane
		# model_text_type = all_modelTextType[0]# Obtain or create a ModelTextType
		# position = pointsXY_modelText  # Specify the position
		# text = "Selected Point"  # Specify the text
		# horizontal_align = HorizontalAlign.Left  # Specify the horizontal alignment
		# depth = 1.0  # Specify the depth
		# modelTexts = create_model_text(doc, text, model_text_type, sketch_plane, position,horizontal_align,  depth)

		TransactionManager.Instance.TransactionTaskDone()			
		pass
	"""_____________________________________________________________________________________"""	
	def Clb_XYValueSelectedIndexChanged(self, sender, e):
		pass
	"""_____________________________________________________________________________________"""
	def Btt_getZClick(self, sender, e):
		TransactionManager.Instance.EnsureInTransaction(doc)

		activeView = doc.ActiveView
		iRefPlane = Plane.CreateByNormalAndOrigin(activeView.ViewDirection, activeView.Origin)
		sketchPlane = SketchPlane.Create(doc, iRefPlane)
		doc.ActiveView.SketchPlane = sketchPlane
		condition = True
		pointsZ = []
		n = 0

		msg = "Pick Points on Current Section plane, hit ESC when finished."
		TaskDialog.Show("^---Ai An Banh Mi Khong??---^", msg)

		while condition:
			try:
				# logger('Line383:', n)
				pt=uidoc.Selection.PickPoint()
				n += 1
				pointsZ.append(pt)
			except :
				condition = False
		doc.Delete(sketchPlane.Id)	
		for j in pointsZ:
			rpM = Autodesk.DesignScript.Geometry.Point.ByCoordinates(j.X, j.Y, j.Z)
			self._clb_ZValue.Items.Add(rpM)
		TransactionManager.Instance.TransactionTaskDone()			
		pass
	"""_________________________________________________________"""
	def Clb_ZValueSelectedIndexChanged(self, sender, e):
		pass
	"""_________________________________________________________"""
	def Cbb_PipingSystemTypeSelectedIndexChanged(self, sender, e):
		# self._cbb_PipingSystemType.selectedIndex = 0	
		pass
	"""_________________________________________________________"""
	def Cbb_PipeTypeSelectedIndexChanged(self, sender, e):
		pass
	"""__________________________________________________________"""
	def Cbb_RefLevelSelectedIndexChanged(self, sender, e):
		pass
	"""__________________________________________________________"""
	def Txb_DiameterTextChanged(self, sender, e):
		pass
	"""__________________________________________________________"""
	def Btt_OKClick(self, sender, e):
		pipingSystem = self._cbb_PipingSystemType.SelectedItem
		all_PipingSystem = getAllPipingSystems(doc)		
		all_PipingSystemsName = getAllPipingSystemsName(doc)
		sel_PipingSystemIdx = all_PipingSystemsName.index(pipingSystem)
		sel_pipingSystem = all_PipingSystem[sel_PipingSystemIdx]		
		"""______________________________________________________"""
		pipeType = self._cbb_PipeType.SelectedItem
		all_PipeTypes = getAllPipeTypes(doc)
		all_PipeTypesName = getAllPipeTypesName(doc)
		sel_PipeTypeIdx = all_PipeTypesName.index(pipeType)
		sel_PipeType = all_PipeTypes[sel_PipeTypeIdx]
		"""______________________________________________________"""
		refLevel = self._cbb_RefLevel.SelectedItem
		all_Levels = list(levelsCollector)
		sel_LevelIdx = all_Levels.index(refLevel)
		sel_Level = all_Levels[sel_LevelIdx]
		"""_______________________________________________________"""
		diameter1 = self._txb_Diameter.Text
		if diameter1.strip():
			try:
				diameter = int(diameter1)
			except vars.ValueError:
				diameter = None
		else:
			diameter = None
		#_________________________________________________________#
		point_XYValues = []
		point_ZValues = []
		desPointsList = []
		for pXY in self._clb_XYValue.CheckedItems:
			point_XYValues.append(pXY)
		for pZ in self._clb_ZValue.CheckedItems:
			point_ZValues.append(pZ)
		for pXY ,pZ  in zip(point_XYValues, point_ZValues):
			desPoint = Autodesk.DesignScript.Geometry.Point.ByCoordinates(pXY.X*304.8, pXY.Y*304.8, pZ.Z*304.8)
			desPointsList.append(desPoint)
		lst_Points1 = [i for i in desPointsList]
		lst_Points2 = [i for i in desPointsList[1:]]
		linesList = []
		for pt1, pt2 in zip(lst_Points1,lst_Points2):
			line =  Autodesk.DesignScript.Geometry.Line.ByStartPointEndPoint(pt1,pt2)
			linesList.append(line)
		firstPoint   = [x.StartPoint for x in linesList]
		secondPoint  = [x.EndPoint for x in linesList]
		elements = []
		TransactionManager.Instance.EnsureInTransaction(doc)
		for i,x in enumerate(firstPoint):
			try:
				levelId = sel_Level.Id
				sysTypeId = sel_pipingSystem.Id
				pipeTypeId = sel_PipeType.Id
				diam = diameter
				pipe = Autodesk.Revit.DB.Plumbing.Pipe.Create(doc,sysTypeId,pipeTypeId,levelId,x.ToXyz(),secondPoint[i].ToXyz())
				param = pipe.get_Parameter(BuiltInParameter.RBS_PIPE_DIAMETER_PARAM)
				param.SetValueString(diam.ToString())			
				elements.append(pipe.ToDSType(False))	
			except:
				elements.append(None)
		TransactionManager.Instance.TransactionTaskDone()
		"""________________________________________________________________"""
		if len(elements) != 0:
			msg = "Mission passed"
			TaskDialog.Show("^---Congrat---^", msg)	
		else: 	
			msg = "Mission Failed"
			TaskDialog.Show("^---Try again---^", msg)				
		self.Close()
		pass
	"""_____________________________________________________________________"""
	def Btt_CANCLEClick(self, sender, e):
		self.Close()
		pass
	def Cb_AllXYCheckedChanged(self, sender, e):
		pass

	def Total_XYValueTextChanged(self, sender, e):
		pass

	def Cbb_AllZCheckedChanged(self, sender, e):
		pass

	def Total_ZValueTextChanged(self, sender, e):
		pass	
f = MainForm()
Application.Run(f)
# ----------------------------------------
python_script_12 = Python()  # IronPython2; unwired: IN[0]
# ---------- python_script_12.python (50 lines) ----------
"""Copyright by: vudinhduybm@gmail.com"""
import clr 
import sys 
import System   
import math
clr.AddReference("ProtoGeometry")
from Autodesk.DesignScript.Geometry import *

clr.AddReference("RevitAPI") 
from Autodesk.Revit.DB import*
from Autodesk.Revit.DB.Structure import*

clr.AddReference("RevitAPIUI") 
from Autodesk.Revit.UI import*

clr.AddReference("System") 
from System.Collections.Generic import List

clr.AddReference("RevitNodes")
import Revit
clr.ImportExtensions(Revit.Elements)
clr.ImportExtensions(Revit.GeometryConversion)

clr.AddReference("RevitServices")
import RevitServices
from RevitServices.Persistence import DocumentManager
from RevitServices.Transactions import TransactionManager

#Current doc/app/ui
doc = DocumentManager.Instance.CurrentDBDocument
uiapp = DocumentManager.Instance.CurrentUIApplication
app = uiapp.Application
uidoc = DocumentManager.Instance.CurrentUIApplication.ActiveUIDocument
view = doc.ActiveView

#Preparing input from dynamo to revit

pipesList = UnwrapElement(IN[0])

def GetParameterByName(lstEle,para):
    paramList = []
    for ele in lstEle:
        ele_Param = math.ceil(ele.get_Parameter(para).AsDouble()*304.8)
        paramList.append(ele_Param)
    return paramList

#_____________________________________________________________________#
value = GetParameterByName(pipesList, BuiltInParameter.CURVE_ELEM_LENGTH)

OUT = value
# ----------------------------------------
boolean_13 = BoolSelector(true)  # frozen
pickObjects = Custom[pickObjects](Reset=boolean_13)  # package Duynamo; from Duynamo to pick Objects
code_block_7 = CodeBlock(a=pickObjects.element) { a; }
python_script_13 = Python(IN[0]=code_block_7)  # IronPython2
# ---------- python_script_13.python (46 lines) ----------
"""Copyright by: vudinhduybm@gmail.com"""
import clr 
import sys 
import System   
import math

clr.AddReference("ProtoGeometry")
from Autodesk.DesignScript.Geometry import *

clr.AddReference("RevitAPI") 
from Autodesk.Revit.DB import*
from Autodesk.Revit.DB.Structure import*

clr.AddReference("RevitAPIUI") 
from Autodesk.Revit.UI import*

clr.AddReference("System") 
from System.Collections.Generic import List

clr.AddReference("RevitNodes")
import Revit
clr.ImportExtensions(Revit.Elements)
clr.ImportExtensions(Revit.GeometryConversion)

clr.AddReference("RevitServices")
import RevitServices
from RevitServices.Persistence import DocumentManager
from RevitServices.Transactions import TransactionManager

#Current doc/app/ui
doc = DocumentManager.Instance.CurrentDBDocument
uiapp = DocumentManager.Instance.CurrentUIApplication
app = uiapp.Application
uidoc = DocumentManager.Instance.CurrentUIApplication.ActiveUIDocument
view = doc.ActiveView

pipeList = UnwrapElement(IN[0])

for pipe in pipeList:
	param = pipe.LookupParameter("True Length")
	pipeLength = pipe.LookupParameter("Length").AsDouble()*304.8
	TransactionManager.Instance.EnsureInTransaction(doc)
	param.Set(str(math.ceil(pipeLength)))


OUT = pipeList
# ----------------------------------------
python_script_14 = Python(IN[0]=code_block_7)  # IronPython2
# ---------- python_script_14.python (62 lines) ----------
import clr

clr.AddReference("RevitServices")
import RevitServices
from RevitServices.Persistence import DocumentManager
from RevitServices.Transactions import TransactionManager
doc = DocumentManager.Instance.CurrentDBDocument

clr.AddReference("RevitAPI")
from Autodesk.Revit.DB import *

clr.AddReference("RevitNodes")
import Revit
clr.ImportExtensions(Revit.Elements)
clr.ImportExtensions(Revit.GeometryConversion)


pipes = UnwrapElement(IN[0])
margin = 1

fittings = []
connectors = {}
connlist = []

for pipe in pipes:
	conns = pipe.ConnectorManager.Connectors
	for conn in conns:
		if conn.IsConnected:
			continue
		connectors[conn] = None
		connlist.append(conn)

for k in connectors.keys():
	mindist = 1000000
	closest = None
	for conn in connlist:
		if conn.Owner.Id.Equals(k.Owner.Id):
			continue
		dist = k.Origin.DistanceTo(conn.Origin)
		if dist < mindist:
			mindist = dist
			closest = conn
	if mindist > margin:
		continue
	connectors[k] = closest
	connlist.remove(closest)
	try:
		del connectors[closest]
	except:
		pass


for k,v in connectors.items():
	TransactionManager.Instance.EnsureInTransaction(doc)		
	try:
		fitting = doc.Create.NewElbowFitting(k,v)
		fittings.append(fitting.ToDSType(False))
	except:
		pass
	TransactionManager.Instance.TransactionTaskDone()

OUT = fittings
# ----------------------------------------
boolean_14 = BoolSelector(true)  # frozen
pickObjects_2 = Custom[pickObjects](Reset=boolean_14)
python_script_15 = Python(IN[0]=pickObjects_2.element)  # IronPython2
# ---------- python_script_15.python (49 lines) ----------
"""Copyright by: vudinhduybm@gmail.com"""
import clr 
import sys 
import System   
clr.AddReference("ProtoGeometry")
from Autodesk.DesignScript.Geometry import *

clr.AddReference("RevitAPI") 
from Autodesk.Revit.DB import*
from Autodesk.Revit.DB.Structure import*

clr.AddReference("RevitAPIUI") 
from Autodesk.Revit.UI import*

clr.AddReference("System") 
from System.Collections.Generic import List

clr.AddReference("RevitNodes")
import Revit
clr.ImportExtensions(Revit.Elements)
clr.ImportExtensions(Revit.GeometryConversion)

clr.AddReference("RevitServices")
import RevitServices
from RevitServices.Persistence import DocumentManager
from RevitServices.Transactions import TransactionManager

#Current doc/app/ui
doc = DocumentManager.Instance.CurrentDBDocument
uiapp = DocumentManager.Instance.CurrentUIApplication
app = uiapp.Application
uidoc = DocumentManager.Instance.CurrentUIApplication.ActiveUIDocument
view = doc.ActiveView


element = UnwrapElement(IN[0])

fittings = []
connectors = {}
connlist = []
for pipe in element:
	conns = pipe.ConnectorManager.Connectors
	for conn in conns:
		if conn.IsConnected:
			continue
		connectors[conn] = None
		connlist.append(conn)

OUT = connlist
# ----------------------------------------

# group: List Flatten
code_block_8 = CodeBlock { lst = [[1,2],[22,55],[111111,2,3,45,6,7,8]]; }
code_block_9 = CodeBlock(a=code_block_8) { a; }
code_block_10 = CodeBlock(x=code_block_9) { List.Flatten(x); }
flatten_by_import_dscorenodes = Python(IN[0]=code_block_8)  # "Flatten by import DSCoreNodes class"; IronPython2
# ---------- flatten_by_import_dscorenodes.python (46 lines) ----------
"""Copyright by: vudinhduybm@gmail.com"""
import clr 
import System
import math 
from System.Collections.Generic import *

clr.AddReference("ProtoGeometry")
from Autodesk.DesignScript.Geometry import *

clr.AddReference('RevitAPI')
import Autodesk
from Autodesk.Revit.DB import *

clr.AddReference('RevitAPIUI')
from Autodesk.Revit.UI import*
from  Autodesk.Revit.UI.Selection import*

clr.AddReference("RevitNodes")
import Revit
clr.ImportExtensions(Revit.Elements)
clr.ImportExtensions(Revit.GeometryConversion)

clr.AddReference("RevitServices")
import RevitServices
from RevitServices.Persistence import DocumentManager
from RevitServices.Transactions import TransactionManager

clr.AddReference("DSCoreNodes")
from DSCore.List import Flatten

doc = DocumentManager.Instance.CurrentDBDocument
view = doc.ActiveView
uidoc = DocumentManager.Instance.CurrentUIApplication.ActiveUIDocument

#Preparing input from dynamo to revit
element = UnwrapElement(IN[0])

#Do some action in a Transaction
TransactionManager.Instance.EnsureInTransaction(doc)
"""Now, You Can Code """



TransactionManager.Instance.TransactionTaskDone()

OUT = Flatten(IN[0])
# ----------------------------------------
flatten_by_hasattr_and = Python(IN[0]=code_block_8)  # "Flatten by hasattr and isinstance function"; IronPython2
# ---------- flatten_by_hasattr_and.python (51 lines) ----------
"""Copyright by: vudinhduybm@gmail.com"""
import clr 
import System
import math 
from System.Collections.Generic import *

clr.AddReference("ProtoGeometry")
from Autodesk.DesignScript.Geometry import *

clr.AddReference('RevitAPI')
import Autodesk
from Autodesk.Revit.DB import *

clr.AddReference('RevitAPIUI')
from Autodesk.Revit.UI import*
from  Autodesk.Revit.UI.Selection import*

clr.AddReference("RevitNodes")
import Revit
clr.ImportExtensions(Revit.Elements)
clr.ImportExtensions(Revit.GeometryConversion)

clr.AddReference("RevitServices")
import RevitServices
from RevitServices.Persistence import DocumentManager
from RevitServices.Transactions import TransactionManager

doc = DocumentManager.Instance.CurrentDBDocument
view = doc.ActiveView
uidoc = DocumentManager.Instance.CurrentUIApplication.ActiveUIDocument

#Preparing input from dynamo to revit
element = UnwrapElement(IN[0])

#Do some action in a Transaction
TransactionManager.Instance.EnsureInTransaction(doc)
"""Now, You Can Code """
def flatten(x):
    result = []
    try:
    	for el in x:
        	if hasattr(el, "__iter__") and not isinstance(el, basestring):
        	    result.extend(flatten(el))
        	else:
        	    result.append(el)
    except:
    	result = x
    return result

TransactionManager.Instance.TransactionTaskDone()
OUT = flatten(IN[0])
# ----------------------------------------
flatten_by_import_collections = Python(IN[0]=code_block_8)  # "Flatten by import collections class"; IronPython2
# ---------- flatten_by_import_collections.python (48 lines) ----------
"""Copyright by: vudinhduybm@gmail.com"""
import clr 
import System
import math 
from System.Collections.Generic import *

clr.AddReference("ProtoGeometry")
from Autodesk.DesignScript.Geometry import *

clr.AddReference('RevitAPI')
import Autodesk
from Autodesk.Revit.DB import *

clr.AddReference('RevitAPIUI')
from Autodesk.Revit.UI import*
from  Autodesk.Revit.UI.Selection import*

clr.AddReference("RevitNodes")
import Revit
clr.ImportExtensions(Revit.Elements)
clr.ImportExtensions(Revit.GeometryConversion)

clr.AddReference("RevitServices")
import RevitServices
from RevitServices.Persistence import DocumentManager
from RevitServices.Transactions import TransactionManager

import collections

doc = DocumentManager.Instance.CurrentDBDocument
view = doc.ActiveView
uidoc = DocumentManager.Instance.CurrentUIApplication.ActiveUIDocument

#Preparing input from dynamo to revit
element = UnwrapElement(IN[0])

#Do some action in a Transaction
TransactionManager.Instance.EnsureInTransaction(doc)
"""Now, You Can Code """

def flattenList(unflattened_list):
	if isinstance(unflattened_list,collections.Iterable):
		return [sub_element for element in unflattened_list for sub_element in flattenList(element)]
	else:
		return [unflattened_list]

TransactionManager.Instance.TransactionTaskDone()
OUT = flattenList(IN[0])
# ----------------------------------------

byMEPCurves = Custom[Elbow.ByMEPCurves](MEPCurves=pickObjects.element)  # frozen; package MEPover; Takes in a list of MEPCurves (pipe, duct, cable tray, conduit) and will attempt to create elbows where possible. A margin can be entered for max distance between connectors
boolean_15 = BoolSelector(true)  # frozen
python_script_16 = Python(IN[0]=boolean_15)  # IronPython2
# ---------- python_script_16.python (71 lines) ----------
import clr
import sys 
import System   
import math

clr.AddReference("ProtoGeometry")
from Autodesk.DesignScript.Geometry import *

clr.AddReference("RevitAPI") 
import Autodesk
from Autodesk.Revit.DB import* 
from Autodesk.Revit.DB.Structure import*

clr.AddReference("RevitAPIUI") 
from Autodesk.Revit.UI import*

clr.AddReference("System") 
from System.Collections.Generic import List

clr.AddReference("RevitNodes")
import Revit
clr.ImportExtensions(Revit.Elements)
clr.ImportExtensions(Revit.GeometryConversion)

clr.AddReference("RevitServices")
import RevitServices
from RevitServices.Persistence import DocumentManager
from RevitServices.Transactions import TransactionManager

clr.AddReference("System.Windows.Forms")
clr.AddReference("System.Drawing")
clr.AddReference("System.Windows.Forms.DataVisualization")

import System.Windows.Forms 
from System.Windows.Forms import *
import System.Drawing
from System.Drawing import *
"""_______________________________________________________________________________________"""
doc = DocumentManager.Instance.CurrentDBDocument
uiapp = DocumentManager.Instance.CurrentUIApplication
app = uiapp.Application
uidoc = DocumentManager.Instance.CurrentUIApplication.ActiveUIDocument



TransactionManager.Instance.EnsureInTransaction(doc)

activeView = doc.ActiveView
iRefPlane = Plane.CreateByNormalAndOrigin(activeView.ViewDirection, activeView.Origin)
sketchPlane = SketchPlane.Create(doc, iRefPlane)
doc.ActiveView.SketchPlane = sketchPlane
condition = True
points = []
desPoints = []
n = 0
msg = "Pick Points on Current Section plane, hit ESC when finished."
TaskDialog.Show("^------^", msg)
while condition:
	try:
		pt=uidoc.Selection.PickPoint()
		n += 1
		points.append(pt)
	except :
		condition = False
doc.Delete(sketchPlane.Id)	
for j in points:
	rpM = Autodesk.DesignScript.Geometry.Point.ByCoordinates(j.X*304.8, j.Y*304.8, j.Z*304.8)
	desPoints.Add(rpM)
TransactionManager.Instance.TransactionTaskDone()	

OUT = desPoints
# ----------------------------------------
code_block_11 = CodeBlock(x=python_script_16) { List.Flatten(x); }
python_script_17 = Python(IN[0]=code_block_11)  # IronPython2
# ---------- python_script_17.python (82 lines) ----------
import clr
import sys 
import System   
import math

clr.AddReference("ProtoGeometry")
from Autodesk.DesignScript.Geometry import *

clr.AddReference("RevitAPI") 
import Autodesk
from Autodesk.Revit.DB import* 
from Autodesk.Revit.DB.Structure import*

clr.AddReference("RevitAPIUI") 
from Autodesk.Revit.UI import*

clr.AddReference("System") 
from System.Collections.Generic import List

clr.AddReference("RevitNodes")
import Revit
clr.ImportExtensions(Revit.Elements)
clr.ImportExtensions(Revit.GeometryConversion)

clr.AddReference("RevitServices")
import RevitServices
from RevitServices.Persistence import DocumentManager
from RevitServices.Transactions import TransactionManager

clr.AddReference("System.Windows.Forms")
clr.AddReference("System.Drawing")
clr.AddReference("System.Windows.Forms.DataVisualization")

import System.Windows.Forms 
from System.Windows.Forms import *
import System.Drawing
from System.Drawing import *

#Current doc/app/ui
doc = DocumentManager.Instance.CurrentDBDocument
uiapp = DocumentManager.Instance.CurrentUIApplication
app = uiapp.Application
uidoc = DocumentManager.Instance.CurrentUIApplication.ActiveUIDocument
view = doc.ActiveView

#Preparing input from dynamo to revit
points = UnwrapElement(IN[0])
circles = []
modelCurves = []
circle_refs = []
TransactionManager.Instance.EnsureInTransaction(doc)
iRefPlane = Plane.CreateByNormalAndOrigin(view.ViewDirection, view.Origin)
sketchPlane = SketchPlane.Create(doc, iRefPlane)
doc.ActiveView.SketchPlane = sketchPlane
red_color = Autodesk.Revit.DB.Color(255, 0, 0)


fill_pattern_elements = list(FilteredElementCollector(doc).OfClass(FillPatternElement))
hatch_pattern_names = [element.Name for element in fill_pattern_elements if element.GetFillPattern().Target == FillPatternTarget.Model]
fill_pattern = fill_pattern_elements[0]

# Create circles for each center point
TransactionManager.Instance.EnsureInTransaction(doc)

for point in points:

    XYZ_point = XYZ(point.X/304.8, point.Y/304.8, point.Z/304.8)
    radius = 1/304.8*50  # You can set your desired radius
    circle = Arc.Create(XYZ_point, radius, 0.0, 2 * 3.142,  XYZ.BasisX, XYZ.BasisY)
    model_curve = doc.Create.NewModelCurve(circle, sketchPlane)
    #filled_regionArray = FilledRegion.Create(doc, fill_pattern.Id, doc.ActiveView.Id, model_curve)
    circles.append(circle.ToProtoType())
    circle_refs.append(model_curve.GeometryCurve.Reference)
    modelCurves.append(model_curve)
    filled_regionArray = FilledRegion.Create(doc, fill_pattern.Id, view.Id, [circle.Reference])
# End the transaction


TransactionManager.Instance.TransactionTaskDone()

# Output: List of created circles
OUT = fill_pattern
# ----------------------------------------
python_script_18 = Python(IN[0]=code_block_11)  # IronPython2
# ---------- python_script_18.python (78 lines) ----------
import clr
import sys 
import System   
import math

clr.AddReference("ProtoGeometry")
from Autodesk.DesignScript.Geometry import *

clr.AddReference("RevitAPI") 
import Autodesk
from Autodesk.Revit.DB import* 
from Autodesk.Revit.DB.Structure import*

clr.AddReference("RevitAPIUI") 
from Autodesk.Revit.UI import*

clr.AddReference("System") 
from System.Collections.Generic import List

clr.AddReference("RevitNodes")
import Revit
clr.ImportExtensions(Revit.Elements)
clr.ImportExtensions(Revit.GeometryConversion)

clr.AddReference("RevitServices")
import RevitServices
from RevitServices.Persistence import DocumentManager
from RevitServices.Transactions import TransactionManager

clr.AddReference("System.Windows.Forms")
clr.AddReference("System.Drawing")
clr.AddReference("System.Windows.Forms.DataVisualization")

import System.Windows.Forms 
from System.Windows.Forms import *
import System.Drawing
from System.Drawing import *

#Current doc/app/ui
doc = DocumentManager.Instance.CurrentDBDocument
uiapp = DocumentManager.Instance.CurrentUIApplication
app = uiapp.Application
uidoc = DocumentManager.Instance.CurrentUIApplication.ActiveUIDocument
view = doc.ActiveView

#Preparing input from dynamo to revit
points = UnwrapElement(IN[0])
circles = []
modelCurves = []
TransactionManager.Instance.EnsureInTransaction(doc)
iRefPlane = Plane.CreateByNormalAndOrigin(view.ViewDirection, view.Origin)
sketchPlane = SketchPlane.Create(doc, iRefPlane)
doc.ActiveView.SketchPlane = sketchPlane
red_color = Autodesk.Revit.DB.Color(255, 0, 0)


fill_pattern_elements = list(FilteredElementCollector(doc).OfClass(FillPatternElement))
hatch_pattern_names = [element.Name for element in fill_pattern_elements if element.GetFillPattern().Target == FillPatternTarget.Model]
fill_pattern = fill_pattern_elements[0]

# Create circles for each center point
TransactionManager.Instance.EnsureInTransaction(doc)

for point in points:

    XYZ_point = XYZ(point.X/304.8, point.Y/304.8, point.Z/304.8)
    radius = 1/304.8*50  # You can set your desired radius
    circle = Arc.Create(XYZ_point, radius, 0.0, 2 * 3.14,  XYZ.BasisX, XYZ.BasisY)
    model_curve = doc.Create.NewModelCurve(circle, sketchPlane)
    #filled_regionArray = FilledRegion.Create(doc, fill_pattern.Id, doc.ActiveView.Id, model_curve)
    circles.append(circle.ToProtoType())
    modelCurves.append(model_curve)
# End the transaction

TransactionManager.Instance.TransactionTaskDone()

# Output: List of created circles
OUT = fill_pattern.Id
# ----------------------------------------
