# Dynamo graph ScheduleExport.dyn (Dynamo 2.10.1.3976)

boolean = BoolSelector(false)
file_path = Filename("C:\Users\95053\Desktop\Python\RevitAPI-master\RevitAPI\WPF_ExportSchedule\scheduleExport\scheduleExport\MainForm1.py")
python_script = Python(IN[0]=boolean, IN[1]=file_path)  # IronPython2
# ---------- python_script.python (5 lines) ----------
re  = open(r"C:\Users\95053\Desktop\Python\RevitAPI-master\RevitAPI\WPF_ExportSchedule\scheduleExport\scheduleExport\MainForm1.py", "r")

interpret = re.read()

OUT =  interpret
# ----------------------------------------
python_script_from_string = PythonStringNode(script=python_script)  # IronPython2; unwired: IN[0]
python_script_2 = Python()  # IronPython2; unwired: IN[0]
# ---------- python_script_2.python (45 lines) ----------
"""Copyright by: vudinhduybm@gmail.com"""
import clr 
import sys 
import System   
clr.AddReference("ProtoGeometry")
from Autodesk.DesignScript.Geometry import *

clr.AddReference("RevitAPI") 
from Autodesk.Revit.DB import*
from Autodesk.Revit.DB.Structure import*

clr.AddReference("RevitAPIUI") 
from Autodesk.Revit.UI import*

clr.AddReference("System") 
from System.Collections.Generic import List

clr.AddReference("RevitNodes")
import Revit
clr.ImportExtensions(Revit.Elements)
clr.ImportExtensions(Revit.GeometryConversion)

clr.AddReference("RevitServices")
import RevitServices
from RevitServices.Persistence import DocumentManager
from RevitServices.Transactions import TransactionManager

#Current doc/app/ui
doc = DocumentManager.Instance.CurrentDBDocument
uiapp = DocumentManager.Instance.CurrentUIApplication
app = uiapp.Application
uidoc = DocumentManager.Instance.CurrentUIApplication.ActiveUIDocument
view = doc.ActiveView

cateList  =  [i.Name for i in doc.Settings.Categories]
filterRule1 = "Schedules"
idx = cateList.index(filterRule1)
desCate = cateList[idx]

cateByName = UnwrapElement(Revit.Elements.Category.ByName("Schedules"))
bib = System.Enum.ToObject(BuiltInCategory, cateByName.Id.IntegerValue)
allSchedules = FilteredElementCollector(doc).OfCategory(bib).ToElements()


OUT = allSchedules
# ----------------------------------------
code_block = CodeBlock(x=python_script_2) { List.Flatten(x); }
code_block_2 = CodeBlock { "Schedules"; }
indexOf = List.IndexOf(list=code_block, element=code_block_2)
